# Dynamo graph Making Beam Rebar at Middle_22Sept2023.dyn (Dynamo 2.13.1.3887)
# packages: Dynamo for Rebar 2.0.2, Structural Design 2023.4.25

# group: Inputs
hook_length = DoubleInput(200)
select_face_yz_plane_of_beam = DSFaceSelection()  # 1 picked in the model
concrete_cover = DoubleInput(40)
stirrup_rebar_bar_type = RebarBarType("10M", ElementType="Autodesk.Revit.DB.Structure.RebarBarType, RevitAPI, Version=23.0.0.0, Culture=neutral, PublicKeyToken=null")
long_rebar_bar_type = RebarBarType("19M", ElementType="Autodesk.Revit.DB.Structure.RebarBarType, RevitAPI, Version=23.0.0.0, Culture=neutral, PublicKeyToken=null")
select_model_element_of_left = DSModelElementSelection()  # "Select Model Element of Left Beam"; 1 picked in the model
select_model_element_of_column = DSModelElementSelection()  # 1 picked in the model
select_model_element_of_beam = DSModelElementSelection()  # 1 picked in the model
select_model_element_of_right = DSModelElementSelection()  # "Select Model Element of Right Beam"; 1 picked in the model
bars_along_b_of_top_rebar = DoubleInput(3)
bars_along_b_of_bottom_rebar = DoubleInput(4)
stirrup_spacing_at_end_of_beam = DoubleInput(200)
stirrup_spacing_at_middle_of = DoubleInput(400)  # "Stirrup spacing at middle of beam"

# group: Beam and Column Information
concreteBeamColumnCharacteristics = StructuralDesign.Model.Opening.Geometry.ConcreteBeamColumnCharacteristics(element=select_model_element_of_left)
concreteBeamColumnCharacteristics_2 = StructuralDesign.Model.Opening.Geometry.ConcreteBeamColumnCharacteristics(element=select_model_element_of_column)
concreteBeamColumnCharacteristics_3 = StructuralDesign.Model.Opening.Geometry.ConcreteBeamColumnCharacteristics(element=select_model_element_of_beam)
concreteBeamColumnCharacteristics_4 = StructuralDesign.Model.Opening.Geometry.ConcreteBeamColumnCharacteristics(element=select_model_element_of_right)

# group: Create Main Curve of Longitudinal Rebar
perimeterCurves = Surface.PerimeterCurves(surface=select_face_yz_plane_of_beam)
byJoinedCurves = PolyCurve.ByJoinedCurves(curves=perimeterCurves)
rebarDiameter = StructuralDesign.Rebar.Properties.RebarDiameter(rebar=stirrup_rebar_bar_type)
rebarDiameter_2 = StructuralDesign.Rebar.Properties.RebarDiameter(rebar=long_rebar_bar_type)
code_block = CodeBlock(ConcreteCover=concrete_cover, StirrupDia=rebarDiameter, LongDia=rebarDiameter_2) { (ConcreteCover+StirrupDia+0.5*LongDia)*-1; }
offset = Curve.Offset(curve=byJoinedCurves, distance=code_block)
byJoinedCurves_2 = PolyCurve.ByJoinedCurves(curves=offset@L1)
curves = PolyCurve.Curves(polyCurve=byJoinedCurves_2)
startPoint = Curve.StartPoint(curve=curves@L1)
firstItem = List.FirstItem(list=startPoint@L2)
XAxis = Vector.XAxis()
reverse = Vector.Reverse(vector=XAxis)
code_block_2 = CodeBlock(LeftBeamLength=concreteBeamColumnCharacteristics.Length, columnwidth=concreteBeamColumnCharacteristics_2.Width) { 0.25*LeftBeamLength+0.5*columnwidth; }
byStartPointDirectionLength = Line.ByStartPointDirectionLength(startPoint=firstItem, direction=reverse, length=code_block_2)
lastItem = List.LastItem(list=startPoint@L2)
byStartPointDirectionLength_2 = Line.ByStartPointDirectionLength(startPoint=lastItem, direction=reverse, length=code_block_2)

# group: Create Curve for Anchorage Hook Length and Combine It with Longitudinal Rebar
endPoint = Curve.EndPoint(curve=byStartPointDirectionLength)
XAxis_2 = Vector.XAxis()
code_block_3 = CodeBlock(RightBeamLength=concreteBeamColumnCharacteristics_4.Length) { 0.25*RightBeamLength; }
code_block_4 = CodeBlock(LengthLeft=code_block_2, BeamLength=concreteBeamColumnCharacteristics_3.Length, LengthRight=code_block_3) { LengthLeft+BeamLength+LengthRight; }
byStartPointDirectionLength_3 = Line.ByStartPointDirectionLength(startPoint=endPoint, direction=XAxis_2, length=code_block_4)
endPoint_2 = Curve.EndPoint(curve=byStartPointDirectionLength_2)
byStartPointDirectionLength_4 = Line.ByStartPointDirectionLength(startPoint=endPoint_2, direction=XAxis_2, length=code_block_4)
startPoint_2 = Curve.StartPoint(curve=byStartPointDirectionLength_2)

# group: Information to create long. rebar
id = Element.Id(element=select_model_element_of_beam)
rebar_style = RebarStyle("Standard", EnumerationType="Autodesk.Revit.DB.Structure.RebarStyle, RevitAPI, Version=23.0.0.0, Culture=neutral, PublicKeyToken=null")
rebar_hook_orientation = RebarHookOrientation("Right", EnumerationType="Autodesk.Revit.DB.Structure.RebarHookOrientation, RevitAPI, Version=23.0.0.0, Culture=neutral, PublicKeyToken=null")
rebar_hook_type = RevitRebarHookType("None", ElementType="Autodesk.Revit.DB.Structure.RebarHookType, RevitAPI, Version=23.0.0.0, Culture=neutral, PublicKeyToken=null")
YAxis = Vector.YAxis()

# group: Create and Distribute Top and Bottom Rebar
byCurve = Rebar.ByCurve(curve=byStartPointDirectionLength_3, hostElementId=id, rebarStyle=rebar_style, rebarBarType=long_rebar_bar_type, startHookOrientation=rebar_hook_orientation, endHookOrientation=rebar_hook_orientation, startHookType=rebar_hook_type, endHookType=rebar_hook_type, vector=YAxis)
code_block_5 = CodeBlock(BeamWidth=concreteBeamColumnCharacteristics_3.Width, cover=concrete_cover, StirrupDia=rebarDiameter, LongDia=rebarDiameter_2) { BeamWidth-2*cover-2*StirrupDia-LongDia; }
setLayoutAsFixedNumber = StructuralDesign.Rebar.Layout.SetLayoutAsFixedNumber(rebar=byCurve, arrayLength=code_block_5, numberOfBarPositions=bars_along_b_of_top_rebar)
byCurve_2 = Rebar.ByCurve(curve=byStartPointDirectionLength_4, hostElementId=id, rebarStyle=rebar_style, rebarBarType=long_rebar_bar_type, startHookOrientation=rebar_hook_orientation, endHookOrientation=rebar_hook_orientation, startHookType=rebar_hook_type, endHookType=rebar_hook_type, vector=YAxis)
setLayoutAsFixedNumber_2 = StructuralDesign.Rebar.Layout.SetLayoutAsFixedNumber(rebar=byCurve_2, arrayLength=code_block_5, numberOfBarPositions=bars_along_b_of_bottom_rebar)

# group: Create Stirrup Curve
perimeterCurves_2 = Surface.PerimeterCurves(surface=select_face_yz_plane_of_beam)
byJoinedCurves_3 = PolyCurve.ByJoinedCurves(curves=perimeterCurves_2)
code_block_6 = CodeBlock(ConcreteCover=concrete_cover) { ConcreteCover*-1; }
offset_2 = Curve.Offset(curve=byJoinedCurves_3, distance=code_block_6)
byJoinedCurves_4 = PolyCurve.ByJoinedCurves(curves=offset_2)

# group: Information to Create Stirrup
id_2 = Element.Id(element=select_model_element_of_beam)
rebar_style_2 = RebarStyle("StirrupTie", EnumerationType="Autodesk.Revit.DB.Structure.RebarStyle, RevitAPI, Version=23.0.0.0, Culture=neutral, PublicKeyToken=null")
rebar_hook_orientation_2 = RebarHookOrientation("Right", EnumerationType="Autodesk.Revit.DB.Structure.RebarHookOrientation, RevitAPI, Version=23.0.0.0, Culture=neutral, PublicKeyToken=null")
rebar_hook_type_2 = RevitRebarHookType("Stirrup/Tie - 135 deg.", ElementType="Autodesk.Revit.DB.Structure.RebarHookType, RevitAPI, Version=23.0.0.0, Culture=neutral, PublicKeyToken=null")
XAxis_3 = Vector.XAxis()

# group: Calculate Distribution Length of Stirrup
length_of_stirrup_dist_at_the = CodeBlock(BeamLength=concreteBeamColumnCharacteristics_3.Length, cover=concrete_cover, ColumnWidth=concreteBeamColumnCharacteristics_2.Width) { (BeamLength-2*cover-ColumnWidth)*0.25; }  # "Length of stirrup dist. at the end of beam"
code_block_7 = CodeBlock(BeamLength=concreteBeamColumnCharacteristics_3.Length, STLength1=length_of_stirrup_dist_at_the, cover=concrete_cover, ColumnWidth=concreteBeamColumnCharacteristics_2.Width) { BeamLength-2*STLength1-2*cover-ColumnWidth; }

# group: Create and Distribute Top and Bottom Rebar
code_block_8 = CodeBlock(BeamWidth=concreteBeamColumnCharacteristics_3.Width, StirrupDia=rebarDiameter, LongDia=rebarDiameter_2) { BeamWidth-2*StirrupDia-LongDia; }
byCurve_3 = Rebar.ByCurve(curve=byJoinedCurves_4, hostElementId=id_2, rebarStyle=rebar_style_2, rebarBarType=stirrup_rebar_bar_type, startHookOrientation=rebar_hook_orientation_2, endHookOrientation=rebar_hook_orientation_2, startHookType=rebar_hook_type_2, endHookType=rebar_hook_type_2, vector=XAxis_3)
setLayoutAsMaximumSpacing = StructuralDesign.Rebar.Layout.SetLayoutAsMaximumSpacing(rebar=byCurve_3, spacing=stirrup_spacing_at_end_of_beam, arrayLength=length_of_stirrup_dist_at_the)
translate = Geometry.Translate(geometry=byJoinedCurves_4, xTranslation=length_of_stirrup_dist_at_the)
translate_2 = Geometry.Translate(geometry=translate, xTranslation=code_block_7)
byCurve_4 = Rebar.ByCurve(curve=translate_2, hostElementId=id_2, rebarStyle=rebar_style_2, rebarBarType=stirrup_rebar_bar_type, startHookOrientation=rebar_hook_orientation_2, endHookOrientation=rebar_hook_orientation_2, startHookType=rebar_hook_type_2, endHookType=rebar_hook_type_2, vector=XAxis_3)
setLayoutAsMaximumSpacing_2 = StructuralDesign.Rebar.Layout.SetLayoutAsMaximumSpacing(rebar=byCurve_4, spacing=stirrup_spacing_at_end_of_beam, arrayLength=length_of_stirrup_dist_at_the)
byCurve_5 = Rebar.ByCurve(curve=translate, hostElementId=id_2, rebarStyle=rebar_style_2, rebarBarType=stirrup_rebar_bar_type, startHookOrientation=rebar_hook_orientation_2, endHookOrientation=rebar_hook_orientation_2, startHookType=rebar_hook_type_2, endHookType=rebar_hook_type_2, vector=XAxis_3)
boolean = BoolSelector(false)
setLayoutAsMaximumSpacing_3 = StructuralDesign.Rebar.Layout.SetLayoutAsMaximumSpacing(rebar=byCurve_5, spacing=stirrup_spacing_at_middle_of, arrayLength=code_block_7, includeFirstBar=boolean, includeLastBar=boolean)
