# Dynamo graph Making Beam Stirrup Rebar_19Sept2023.dyn (Dynamo 2.13.1.3887)
# packages: Structural Design 2023.4.25, Dynamo for Rebar 2.0.2, BIM4Struc.Rebar 1.3.0

# group: Inputs
select_face_of_beam = DSFaceSelection()  # 1 picked in the model
beam_concrete_cover = DoubleInput(40)
select_model_element_of_beam = DSModelElementSelection()  # 1 picked in the model
stirrup_rebar_bar_type = RebarBarType("10M", ElementType="Autodesk.Revit.DB.Structure.RebarBarType, RevitAPI, Version=23.0.0.0, Culture=neutral, PublicKeyToken=null")
spacing_of_stirrup_at_end_of = DoubleInput(200)  # "Spacing of stirrup at end of beam"
select_model_element_of_column = DSModelElementSelection()  # 1 picked in the model
spacing_of_stirrup_at_middle_of = DoubleInput(400)  # "Spacing of stirrup at middle of beam"

# group: Create Stirrup Curves
perimeterCurves = Surface.PerimeterCurves(surface=select_face_of_beam)
byJoinedCurves = PolyCurve.ByJoinedCurves(curves=perimeterCurves)
code_block = CodeBlock(ConcreteCover=beam_concrete_cover) { ConcreteCover*-1; }
offset = Curve.Offset(curve=byJoinedCurves, distance=code_block)
byJoinedCurves_2 = PolyCurve.ByJoinedCurves(curves=offset@L1)
translate = Geometry.Translate(geometry=byJoinedCurves_2, xTranslation=beam_concrete_cover)

select_face = DSFaceSelection()  # 1 picked in the model
perimeterCurves_2 = Surface.PerimeterCurves(surface=select_face)
byJoinedCurves_3 = PolyCurve.ByJoinedCurves(curves=perimeterCurves_2)
concrete_cover = DoubleInput(40)
code_block_2 = CodeBlock(ConcreteCover=concrete_cover) { ConcreteCover*-1; }
offset_2 = Curve.Offset(curve=byJoinedCurves_3, distance=code_block_2)
byJoinedCurves_4 = PolyCurve.ByJoinedCurves(curves=offset_2@L1)
select_model_element = DSModelElementSelection()  # 1 picked in the model
concreteBeamColumnCharacteristics = StructuralDesign.Model.Opening.Geometry.ConcreteBeamColumnCharacteristics(element=select_model_element)
select_model_element_2 = DSModelElementSelection()  # 1 picked in the model
concreteBeamColumnCharacteristics_2 = StructuralDesign.Model.Opening.Geometry.ConcreteBeamColumnCharacteristics(element=select_model_element_2)
length_of_stirrup_dist_at_the = CodeBlock(BeamLength=concreteBeamColumnCharacteristics.Length, cover=concrete_cover, WidthColumn=concreteBeamColumnCharacteristics_2.Width) { (BeamLength-2*cover-WidthColumn)*1/4; }  # "Length of stirrup dist. at the end of beam"
translate_2 = Geometry.Translate(geometry=byJoinedCurves_4, xTranslation=length_of_stirrup_dist_at_the)
length_of_stirrup_dist_in_the = CodeBlock(BeamLength=concreteBeamColumnCharacteristics.Length, STLength1=length_of_stirrup_dist_at_the, cover=concrete_cover, WidthColumn=concreteBeamColumnCharacteristics_2.Width) { BeamLength-2*STLength1-2*cover-WidthColumn; }  # "Length of stirrup dist. in the middle of beam"
translate_3 = Geometry.Translate(geometry=translate_2, xTranslation=length_of_stirrup_dist_in_the)
id = Element.Id(element=select_model_element)
rebar_style = RebarStyle("StirrupTie", EnumerationType="Autodesk.Revit.DB.Structure.RebarStyle, RevitAPI, Version=23.0.0.0, Culture=neutral, PublicKeyToken=null")
stirrup_rebar_bar_type_2 = RebarBarType("10M", ElementType="Autodesk.Revit.DB.Structure.RebarBarType, RevitAPI, Version=23.0.0.0, Culture=neutral, PublicKeyToken=null")
rebar_hook_orientation = RebarHookOrientation("Right", EnumerationType="Autodesk.Revit.DB.Structure.RebarHookOrientation, RevitAPI, Version=23.0.0.0, Culture=neutral, PublicKeyToken=null")
rebar_hook_type = RevitRebarHookType("Stirrup/Tie - 135 deg.", ElementType="Autodesk.Revit.DB.Structure.RebarHookType, RevitAPI, Version=23.0.0.0, Culture=neutral, PublicKeyToken=null")
XAxis = Vector.XAxis()
byCurve = Rebar.ByCurve(curve=translate_3, hostElementId=id, rebarStyle=rebar_style, rebarBarType=stirrup_rebar_bar_type_2, startHookOrientation=rebar_hook_orientation, endHookOrientation=rebar_hook_orientation, startHookType=rebar_hook_type, endHookType=rebar_hook_type, vector=XAxis)
spacing_of_stirrup_at_end_of_2 = DoubleInput(200)  # "Spacing of stirrup at end of beam"
setLayoutAsMaximumSpacing = StructuralDesign.Rebar.Layout.SetLayoutAsMaximumSpacing(rebar=byCurve, spacing=spacing_of_stirrup_at_end_of_2, arrayLength=length_of_stirrup_dist_at_the)
setRebarShapeId = StructuralDesign.Rebar.Create.SetRebarShapeId(rebar=setLayoutAsMaximumSpacing)  # unwired: rebarShape
views = Views("{3D}")
setSolidInView = Custom[Rebar.SetSolidInView](rebarElements=setRebarShapeId, views=views)  # package BIM4Struc.Rebar; Sets this rebar element to be shown solidly in a 3D view.
byCurve_2 = Rebar.ByCurve(curve=translate_2, hostElementId=id, rebarStyle=rebar_style, rebarBarType=stirrup_rebar_bar_type_2, startHookOrientation=rebar_hook_orientation, endHookOrientation=rebar_hook_orientation, startHookType=rebar_hook_type, endHookType=rebar_hook_type, vector=XAxis)
spacing_of_stirrup_at_middle_of_2 = DoubleInput(400)  # "Spacing of stirrup at middle of beam"
boolean = BoolSelector(false)
setLayoutAsMaximumSpacing_2 = StructuralDesign.Rebar.Layout.SetLayoutAsMaximumSpacing(rebar=byCurve_2, spacing=spacing_of_stirrup_at_middle_of_2, arrayLength=length_of_stirrup_dist_in_the, includeFirstBar=boolean, includeLastBar=boolean)
setRebarShapeId_2 = StructuralDesign.Rebar.Create.SetRebarShapeId(rebar=setLayoutAsMaximumSpacing_2)  # unwired: rebarShape
setSolidInView_2 = Custom[Rebar.SetSolidInView](rebarElements=setRebarShapeId_2, views=views)
rebarShape = RevitRebarShape()  # nothing selected; frozen
rebarShape_2 = RevitRebarShape()  # nothing selected
byCurve_3 = Rebar.ByCurve(curve=byJoinedCurves_4, hostElementId=id, rebarStyle=rebar_style, rebarBarType=stirrup_rebar_bar_type_2, startHookOrientation=rebar_hook_orientation, endHookOrientation=rebar_hook_orientation, startHookType=rebar_hook_type, endHookType=rebar_hook_type, vector=XAxis)
setLayoutAsMaximumSpacing_3 = StructuralDesign.Rebar.Layout.SetLayoutAsMaximumSpacing(rebar=byCurve_3, spacing=spacing_of_stirrup_at_end_of_2, arrayLength=length_of_stirrup_dist_at_the)
setRebarShapeId_3 = StructuralDesign.Rebar.Create.SetRebarShapeId(rebar=setLayoutAsMaximumSpacing_3)  # unwired: rebarShape
setSolidInView_3 = Custom[Rebar.SetSolidInView](rebarElements=setRebarShapeId_3, views=views)
longitudinal_rebar_bar_type = RebarBarType("19M", ElementType="Autodesk.Revit.DB.Structure.RebarBarType, RevitAPI, Version=23.0.0.0, Culture=neutral, PublicKeyToken=null")
translate_4 = Geometry.Translate(geometry=byJoinedCurves_4, xTranslation=concrete_cover)

# group: Stirrup Rebar Information
id_2 = Element.Id(element=select_model_element_of_beam)
rebar_style_2 = RebarStyle("StirrupTie", EnumerationType="Autodesk.Revit.DB.Structure.RebarStyle, RevitAPI, Version=23.0.0.0, Culture=neutral, PublicKeyToken=null")
rebar_hook_orientation_2 = RebarHookOrientation("Right", EnumerationType="Autodesk.Revit.DB.Structure.RebarHookOrientation, RevitAPI, Version=23.0.0.0, Culture=neutral, PublicKeyToken=null")
rebar_hook_type_2 = RevitRebarHookType("Stirrup/Tie - 135 deg.", ElementType="Autodesk.Revit.DB.Structure.RebarHookType, RevitAPI, Version=23.0.0.0, Culture=neutral, PublicKeyToken=null")
XAxis_2 = Vector.XAxis()

# group: Elements Information
concreteBeamColumnCharacteristics_3 = StructuralDesign.Model.Opening.Geometry.ConcreteBeamColumnCharacteristics(element=select_model_element_of_beam)
concreteBeamColumnCharacteristics_4 = StructuralDesign.Model.Opening.Geometry.ConcreteBeamColumnCharacteristics(element=select_model_element_of_column)

# group: Calculate Stirrup Distribution Length
length_of_stirrup_dist_at_the_2 = CodeBlock(BeamLength=concreteBeamColumnCharacteristics_3.Length, cover=beam_concrete_cover, WidthColumn=concreteBeamColumnCharacteristics_4.Width) { (BeamLength-2*cover-WidthColumn)*1/4; }  # "Length of stirrup dist. at the end of beam"
length_of_stirrup_dist_in_the_2 = CodeBlock(BeamLength=concreteBeamColumnCharacteristics_3.Length, STLength1=length_of_stirrup_dist_at_the_2, cover=beam_concrete_cover, WidthColumn=concreteBeamColumnCharacteristics_4.Width) { BeamLength-2*STLength1-2*cover-WidthColumn; }  # "Length of stirrup dist. in the middle of beam"

# group: Generation of Stirrup Rebar
byCurve_4 = Rebar.ByCurve(curve=byJoinedCurves_2, hostElementId=id_2, rebarStyle=rebar_style_2, rebarBarType=stirrup_rebar_bar_type, startHookOrientation=rebar_hook_orientation_2, endHookOrientation=rebar_hook_orientation_2, startHookType=rebar_hook_type_2, endHookType=rebar_hook_type_2, vector=XAxis_2)
translate_5 = Geometry.Translate(geometry=byJoinedCurves_2, xTranslation=length_of_stirrup_dist_at_the_2)
byCurve_5 = Rebar.ByCurve(curve=translate_5, hostElementId=id_2, rebarStyle=rebar_style_2, rebarBarType=stirrup_rebar_bar_type, startHookOrientation=rebar_hook_orientation_2, endHookOrientation=rebar_hook_orientation_2, startHookType=rebar_hook_type_2, endHookType=rebar_hook_type_2, vector=XAxis_2)
translate_6 = Geometry.Translate(geometry=translate_5, xTranslation=length_of_stirrup_dist_in_the_2)
byCurve_6 = Rebar.ByCurve(curve=translate_6, hostElementId=id_2, rebarStyle=rebar_style_2, rebarBarType=stirrup_rebar_bar_type, startHookOrientation=rebar_hook_orientation_2, endHookOrientation=rebar_hook_orientation_2, startHookType=rebar_hook_type_2, endHookType=rebar_hook_type_2, vector=XAxis_2)

# group: Distribution of Stirrup Rebar
setLayoutAsMaximumSpacing_4 = StructuralDesign.Rebar.Layout.SetLayoutAsMaximumSpacing(rebar=byCurve_4, spacing=spacing_of_stirrup_at_end_of, arrayLength=length_of_stirrup_dist_at_the_2)
boolean_2 = BoolSelector(false)
setLayoutAsMaximumSpacing_5 = StructuralDesign.Rebar.Layout.SetLayoutAsMaximumSpacing(rebar=byCurve_5, spacing=spacing_of_stirrup_at_middle_of, arrayLength=length_of_stirrup_dist_in_the_2, includeFirstBar=boolean_2, includeLastBar=boolean_2)
setLayoutAsMaximumSpacing_6 = StructuralDesign.Rebar.Layout.SetLayoutAsMaximumSpacing(rebar=byCurve_6, spacing=spacing_of_stirrup_at_end_of, arrayLength=length_of_stirrup_dist_at_the_2)

# group: Set Rebar Shape and Set as Solid in View
rebarShape_3 = RevitRebarShape()  # nothing selected
setRebarShapeId_4 = StructuralDesign.Rebar.Create.SetRebarShapeId(rebar=setLayoutAsMaximumSpacing_4, rebarShape=rebarShape_3)
views_2 = Views("{3D}")
setSolidInView_4 = Custom[Rebar.SetSolidInView](rebarElements=setRebarShapeId_4, views=views_2)
setRebarShapeId_5 = StructuralDesign.Rebar.Create.SetRebarShapeId(rebar=setLayoutAsMaximumSpacing_5, rebarShape=rebarShape_3)
setSolidInView_5 = Custom[Rebar.SetSolidInView](rebarElements=setRebarShapeId_5, views=views_2)
setRebarShapeId_6 = StructuralDesign.Rebar.Create.SetRebarShapeId(rebar=setLayoutAsMaximumSpacing_6, rebarShape=rebarShape_3)
setSolidInView_6 = Custom[Rebar.SetSolidInView](rebarElements=setRebarShapeId_6, views=views_2)
