# Dynamo graph Making Column Dowel Bar_18Sept2023.dyn (Dynamo 2.13.1.3887)
# packages: Clockwork for Dynamo 2.x 2.6.0, archi-lab.net 2023.213.1722, BIM4Struc.Productivity 2.2.2, Dynamo for Rebar 2.0.2, LunchBox for Dynamo 2017.10.2, BIM4Struc.Rebar 1.3.0, Structural Design 2023.4.25

# group: Inputs
select_model_element_by_category = DSModelElementByCategorySelection("OST_StructuralColumns")  # 1 picked in the model
concrete_cover = DoubleInput(40)
stirrup_rebar_bar_type = RebarBarType("10M", ElementType="Autodesk.Revit.DB.Structure.RebarBarType, RevitAPI, Version=23.0.0.0, Culture=neutral, PublicKeyToken=null")
longitudinal_rebar_bar_type = RebarBarType("22M", ElementType="Autodesk.Revit.DB.Structure.RebarBarType, RevitAPI, Version=23.0.0.0, Culture=neutral, PublicKeyToken=null")
select_model_element_by_category_2 = DSModelElementByCategorySelection("OST_StructuralFoundation")  # 1 picked in the model
lap_splice_length = DoubleInput(500)
l_shape_leg_length = DoubleInput(200)
rebar_bar_type = RebarBarType("22M", ElementType="Autodesk.Revit.DB.Structure.RebarBarType, RevitAPI, Version=23.0.0.0, Culture=neutral, PublicKeyToken=null")

# group: Obtain bottom surface of column
faces = Element.Faces(element=select_model_element_by_category)
code_block = CodeBlock { 1; }
flatten = List.Flatten(list=faces, amount=code_block)
filterByOrientation = Custom[Surface.FilterByOrientation](surfaces=flatten)  # package Clockwork for Dynamo 2.x; Sorts surfaces in three lists based on their orientation (vertical, horizontal up & horizontal down) and also returns three corresponding lists of booleans.

# group: Vector Management
localCoordinateSystem = Custom[Element.LocalCoordinateSystem](element=select_model_element_by_category_2)  # package BIM4Struc.Productivity; Get the insertion point and local axes of an element.
reverse = Vector.Reverse(vector=localCoordinateSystem.Xvector)
reverse_2 = Vector.Reverse(vector=localCoordinateSystem.Yvector)

type = archilab.Revit.Elements.Elements.Type(element=select_model_element_by_category_2)
code_block_2 = CodeBlock { "Foundation Thickness"; }
getParameterValueByName = Element.GetParameterValueByName(element=type, parameterName=code_block_2)
footing_cover = CodeBlock { 50; }
code_block_3 = CodeBlock(FoundationThickness=getParameterValueByName, FootingCover=footing_cover) { FoundationThickness-FootingCover-40; }

# group: Get longitudinal rebar location at bottom of foundation
getBarDiameter = Custom[RebarType.GetBarDiameter](rebarBarType=stirrup_rebar_bar_type)  # package BIM4Struc.Rebar; Get the diameter of a given Rebar Bar Type
getBarDiameter_2 = Custom[RebarType.GetBarDiameter](rebarBarType=longitudinal_rebar_bar_type)
code_block_4 = CodeBlock(StirrupDia=getBarDiameter, LongDia=getBarDiameter_2) { -1*(StirrupDia*0.5+LongDia*0.5); }
ZAxis = Vector.ZAxis()
reverse_3 = Vector.Reverse(vector=ZAxis)

# group: Calculate distribution length of longitudinal rebar
type_2 = archilab.Revit.Elements.Elements.Type(element=select_model_element_by_category)
code_block_5 = CodeBlock { "b"; "h"; "Bars Along b"; }
getParameterValueByName_2 = Element.GetParameterValueByName(element=type_2, parameterName=code_block_5.out2)
getParameterValueByName_3 = Element.GetParameterValueByName(element=type_2, parameterName=code_block_5.out0)
distribution_length_of_long = CodeBlock(width=getParameterValueByName_3, ColumnCover=concrete_cover, StirrupDia=getBarDiameter, LongDia=getBarDiameter_2) { width-2*ColumnCover-2*StirrupDia-LongDia; }  # "Distribution Length of Long. Rebar in X Direction"
getParameterValueByName_4 = Element.GetParameterValueByName(element=type_2, parameterName=code_block_5.out1)
distribution_length_of_long_2 = CodeBlock(depth=getParameterValueByName_4, ColumnCover=concrete_cover, StirrupDia=getBarDiameter, LongDia=getBarDiameter_2) { depth-2*ColumnCover-2*StirrupDia-LongDia; }  # "Distribution Length of Long. Rebar in Y Direction"

# group: Create stirrup curve for foundation
perimeterCurves = Surface.PerimeterCurves(surface=filterByOrientation.horizontalDown)
byJoinedCurves = PolyCurve.ByJoinedCurves(curves=perimeterCurves)
code_block_6 = CodeBlock(cover=concrete_cover, stirrupDia=getBarDiameter) { -1*(cover-0.5*stirrupDia); }
offset = Curve.Offset(curve=byJoinedCurves, distance=code_block_6)

# group (continued): Get longitudinal rebar location at bottom of foundation
offset_2 = Curve.Offset(curve=offset, distance=code_block_4)
byJoinedCurves_2 = PolyCurve.ByJoinedCurves(curves=offset_2@L1)
curves = PolyCurve.Curves(polyCurve=byJoinedCurves_2)
endPoints = Geometry.Curves.EndPoints(curve=curves)
byTwoPoints = Vector.ByTwoPoints(start=endPoints.StartPoint, end=endPoints.EndPoint)
isParallel = Vector.IsParallel(vector=localCoordinateSystem.Xvector, otherVector=byTwoPoints)
filterByBoolMask = List.FilterByBoolMask(list=curves, mask=isParallel)
curve_in_x_direction = CodeBlock(x=filterByBoolMask.in) { x; }
translate = Geometry.Translate(geometry=curve_in_x_direction, direction=reverse_3, distance=code_block_3)

# group: Create curve for longitudinal rebar
endPoints_2 = Geometry.Curves.EndPoints(curve=translate)
lastItem = List.LastItem(list=endPoints_2.StartPoint@L2)
ZAxis_2 = Vector.ZAxis()
anchorage_length_to_foundation = CodeBlock(LapSplice=lap_splice_length, AnchorageLength=code_block_3) { LapSplice+AnchorageLength; }  # "Anchorage Length to Foundation + Lap Splice"
byStartPointDirectionLength = Line.ByStartPointDirectionLength(startPoint=lastItem, direction=ZAxis_2, length=anchorage_length_to_foundation)
firstItem = List.FirstItem(list=endPoints_2.StartPoint@L2)
byStartPointDirectionLength_2 = Line.ByStartPointDirectionLength(startPoint=firstItem, direction=ZAxis_2, length=anchorage_length_to_foundation)

# group: Create dowel bar with leg length
startPoint = Curve.StartPoint(curve=byStartPointDirectionLength)
# note: Last item which will be distributed in X direction
byStartPointDirectionLength_3 = Line.ByStartPointDirectionLength(startPoint=startPoint, direction=localCoordinateSystem.Yvector, length=l_shape_leg_length)
list_create = List.Create(item0=byStartPointDirectionLength, item1=byStartPointDirectionLength_3)
transpose = List.Transpose(lists=list_create)
byJoinedCurves_3 = PolyCurve.ByJoinedCurves(curves=transpose)
startPoint_2 = Curve.StartPoint(curve=byStartPointDirectionLength_2)
# note: First item which will be distributed in Y direction
byStartPointDirectionLength_4 = Line.ByStartPointDirectionLength(startPoint=startPoint_2, direction=localCoordinateSystem.Xvector, length=l_shape_leg_length)
list_create_2 = List.Create(item0=byStartPointDirectionLength_2, item1=byStartPointDirectionLength_4)
transpose_2 = List.Transpose(lists=list_create_2)
byJoinedCurves_4 = PolyCurve.ByJoinedCurves(curves=transpose_2)
# note: Last item which will be distributed in Y direction
byStartPointDirectionLength_5 = Line.ByStartPointDirectionLength(startPoint=startPoint, direction=reverse, length=l_shape_leg_length)
list_create_3 = List.Create(item0=byStartPointDirectionLength, item1=byStartPointDirectionLength_5)
transpose_3 = List.Transpose(lists=list_create_3)
byJoinedCurves_5 = PolyCurve.ByJoinedCurves(curves=transpose_3)
# note: First item which will be distributed in X direction
byStartPointDirectionLength_6 = Line.ByStartPointDirectionLength(startPoint=startPoint_2, direction=reverse_2, length=l_shape_leg_length)
list_create_4 = List.Create(item0=byStartPointDirectionLength_2, item1=byStartPointDirectionLength_6)
transpose_4 = List.Transpose(lists=list_create_4)
byJoinedCurves_6 = PolyCurve.ByJoinedCurves(curves=transpose_4)

# group: Information to create longitudinal rebar
id = Element.Id(element=select_model_element_by_category_2)
rebar_style = RebarStyle("Standard", EnumerationType="Autodesk.Revit.DB.Structure.RebarStyle, RevitAPI, Version=23.0.0.0, Culture=neutral, PublicKeyToken=null")
rebar_hook_orientation = RebarHookOrientation("Right", EnumerationType="Autodesk.Revit.DB.Structure.RebarHookOrientation, RevitAPI, Version=23.0.0.0, Culture=neutral, PublicKeyToken=null")
rebar_hook_type = RevitRebarHookType("None", ElementType="Autodesk.Revit.DB.Structure.RebarHookType, RevitAPI, Version=23.0.0.0, Culture=neutral, PublicKeyToken=null")

code_block_7 = CodeBlock { 4; }

# group: Create Longitudinal Rebar in X Direction
byCurve = Rebar.ByCurve(curve=byJoinedCurves_3, hostElementId=id, rebarStyle=rebar_style, rebarBarType=rebar_bar_type, startHookOrientation=rebar_hook_orientation, endHookOrientation=rebar_hook_orientation, startHookType=rebar_hook_type, endHookType=rebar_hook_type, vector=localCoordinateSystem.Xvector)
setLayoutAsFixedNumber = StructuralDesign.Rebar.Layout.SetLayoutAsFixedNumber(rebar=byCurve, arrayLength=distribution_length_of_long, numberOfBarPositions=code_block_7)
byCurve_2 = Rebar.ByCurve(curve=byJoinedCurves_6, hostElementId=id, rebarStyle=rebar_style, rebarBarType=rebar_bar_type, startHookOrientation=rebar_hook_orientation, endHookOrientation=rebar_hook_orientation, startHookType=rebar_hook_type, endHookType=rebar_hook_type, vector=reverse)
setLayoutAsFixedNumber_2 = StructuralDesign.Rebar.Layout.SetLayoutAsFixedNumber(rebar=byCurve_2, arrayLength=distribution_length_of_long, numberOfBarPositions=code_block_7)

rebarShape = RevitRebarShape("M_17A")
setRebarShapeId = StructuralDesign.Rebar.Create.SetRebarShapeId(rebar=setLayoutAsFixedNumber, rebarShape=rebarShape.out3)
views = Views("{3D}")
setSolidInView = Custom[Rebar.SetSolidInView](rebarElements=setRebarShapeId, views=views)  # package BIM4Struc.Rebar; Sets this rebar element to be shown solidly in a 3D view.
total_rebar = CodeBlock { 22; }

# group: Create Longitudinal Rebar in Y Direction
byCurve_3 = Rebar.ByCurve(curve=byJoinedCurves_4, hostElementId=id, rebarStyle=rebar_style, rebarBarType=rebar_bar_type, startHookOrientation=rebar_hook_orientation, endHookOrientation=rebar_hook_orientation, startHookType=rebar_hook_type, endHookType=rebar_hook_type, vector=localCoordinateSystem.Yvector)
code_block_8 = CodeBlock(TotalRebar=total_rebar, BarsAlongB=code_block_7) { 0.5*(TotalRebar-2*BarsAlongB)+2; }
boolean = BoolSelector(false)
setLayoutAsFixedNumber_3 = StructuralDesign.Rebar.Layout.SetLayoutAsFixedNumber(rebar=byCurve_3, arrayLength=distribution_length_of_long_2, numberOfBarPositions=code_block_8, includeFirstBar=boolean, includeLastBar=boolean)
byCurve_4 = Rebar.ByCurve(curve=byJoinedCurves_5, hostElementId=id, rebarStyle=rebar_style, rebarBarType=rebar_bar_type, startHookOrientation=rebar_hook_orientation, endHookOrientation=rebar_hook_orientation, startHookType=rebar_hook_type, endHookType=rebar_hook_type, vector=reverse_2)
setLayoutAsFixedNumber_4 = StructuralDesign.Rebar.Layout.SetLayoutAsFixedNumber(rebar=byCurve_4, arrayLength=distribution_length_of_long_2, numberOfBarPositions=code_block_8, includeFirstBar=boolean, includeLastBar=boolean)

setRebarShapeId_2 = StructuralDesign.Rebar.Create.SetRebarShapeId(rebar=setLayoutAsFixedNumber_3, rebarShape=rebarShape.out3)
setSolidInView_2 = Custom[Rebar.SetSolidInView](rebarElements=setRebarShapeId_2, views=views)
setRebarShapeId_3 = StructuralDesign.Rebar.Create.SetRebarShapeId(rebar=setLayoutAsFixedNumber_4, rebarShape=rebarShape.out3)
setSolidInView_3 = Custom[Rebar.SetSolidInView](rebarElements=setRebarShapeId_3, views=views)
setRebarShapeId_4 = StructuralDesign.Rebar.Create.SetRebarShapeId(rebar=setLayoutAsFixedNumber_2, rebarShape=rebarShape.out3)
setSolidInView_4 = Custom[Rebar.SetSolidInView](rebarElements=setRebarShapeId_4, views=views)
