# Dynamo graph Making Column Rebar for Top Column with Leg Length_18Sept2023.dyn (Dynamo 2.13.1.3887)
# packages: Structural Design 2023.4.25, Dynamo for Rebar 2.0.2, Clockwork for Dynamo 2.x 2.6.0, BIM4Struc.Productivity 2.2.2, BIM4Struc.Rebar 1.3.0, archi-lab.net 2023.213.1722, LunchBox for Dynamo 2017.10.2

# group: Input
select_model_element_by_category = DSModelElementByCategorySelection("OST_StructuralColumns")  # 1 picked in the model; graph input
concrete_cover = DoubleInput(40)  # graph input
stirrup_rebar_bar_type = RebarBarType("H10", ElementType="Autodesk.Revit.DB.Structure.RebarBarType, RevitAPI, Version=23.0.0.0, Culture=neutral, PublicKeyToken=null")  # graph input
stirrup_spacing_at_end_of_column = DoubleInput(200)  # graph input
stirrup_spacing_in_middle_of = DoubleInput(400)  # "Stirrup Spacing in middle of column"; graph input
vertical_rebar_bar_type = RebarBarType("H16", ElementType="Autodesk.Revit.DB.Structure.RebarBarType, RevitAPI, Version=23.0.0.0, Culture=neutral, PublicKeyToken=null")  # graph input
top_l_shape_leg_length = DoubleInput(300)  # graph input
lap_splice_length = DoubleInput(500)  # graph input

# group: Get column and longitudinal rebar parameter
type = archilab.Revit.Elements.Elements.Type(element=select_model_element_by_category)
code_block = CodeBlock { "b"; "h"; "Bars Along b"; "Bars Along h"; }
getParameterValueByName = Element.GetParameterValueByName(element=type, parameterName=code_block.out2)
getParameterValueByName_2 = Element.GetParameterValueByName(element=type, parameterName=code_block.out3)
concreteBeamColumnCharacteristics = StructuralDesign.Model.Opening.Geometry.ConcreteBeamColumnCharacteristics(element=select_model_element_by_category)
getParameterValueByName_3 = Element.GetParameterValueByName(element=type, parameterName=code_block.out1)
getParameterValueByName_4 = Element.GetParameterValueByName(element=type, parameterName=code_block.out0)

# group: Obtain bottom surface of column
faces = Element.Faces(element=select_model_element_by_category)
code_block_2 = CodeBlock { 1; }
flatten = List.Flatten(list=faces, amount=code_block_2)
filterByOrientation = Custom[Surface.FilterByOrientation](surfaces=flatten)  # package Clockwork for Dynamo 2.x; Sorts surfaces in three lists based on their orientation (vertical, horizontal up & horizontal down) and also returns three corresponding lists of booleans.

# group: Create Stirrup Curves
perimeterCurves = Surface.PerimeterCurves(surface=filterByOrientation.horizontalDown)
byJoinedCurves = PolyCurve.ByJoinedCurves(curves=perimeterCurves)
column_concrete_cover = CodeBlock(ConcreteCover=concrete_cover) { ConcreteCover*-1; }
offset = Curve.Offset(curve=byJoinedCurves, distance=column_concrete_cover)
byJoinedCurves_2 = PolyCurve.ByJoinedCurves(curves=offset@L1)
height_of_stirrup_from_bottom = DoubleInput(50)  # "Height of stirrup from bottom surface"
translate = Geometry.Translate(geometry=byJoinedCurves_2, zTranslation=height_of_stirrup_from_bottom)

# group: Stirrup Rebar Information
id = Element.Id(element=select_model_element_by_category)
rebar_style = RebarStyle("StirrupTie", EnumerationType="Autodesk.Revit.DB.Structure.RebarStyle, RevitAPI, Version=23.0.0.0, Culture=neutral, PublicKeyToken=null")
rebar_hook_orientation = RebarHookOrientation("Right", EnumerationType="Autodesk.Revit.DB.Structure.RebarHookOrientation, RevitAPI, Version=23.0.0.0, Culture=neutral, PublicKeyToken=null")
rebar_hook_type = RevitRebarHookType("Stirrup/Tie - 135 deg.", ElementType="Autodesk.Revit.DB.Structure.RebarHookType, RevitAPI, Version=23.0.0.0, Culture=neutral, PublicKeyToken=null")
ZAxis = Vector.ZAxis()

# group: Calculate Stirrup Distribution Length
length_of_stirrup_dist_at_end_of = CodeBlock(ColumnLength=concreteBeamColumnCharacteristics.Length, cover=concrete_cover) { (ColumnLength-2*cover)*1/4; }  # "Length of stirrup dist. at end of column"
length_of_stirrup_dist_in_the = CodeBlock(ColumnLength=concreteBeamColumnCharacteristics.Length, STLength1=length_of_stirrup_dist_at_end_of, cover=concrete_cover) { ColumnLength-2*STLength1-2*cover; }  # "Length of stirrup dist. in the middle of column"

# group: Generation of Stirrup Rebar
byCurve = Rebar.ByCurve(curve=translate, hostElementId=id, rebarStyle=rebar_style, rebarBarType=stirrup_rebar_bar_type, startHookOrientation=rebar_hook_orientation, endHookOrientation=rebar_hook_orientation, startHookType=rebar_hook_type, endHookType=rebar_hook_type, vector=ZAxis)
translate_2 = Geometry.Translate(geometry=translate, zTranslation=length_of_stirrup_dist_at_end_of)
translate_3 = Geometry.Translate(geometry=translate_2, zTranslation=length_of_stirrup_dist_in_the)
byCurve_2 = Rebar.ByCurve(curve=translate_3, hostElementId=id, rebarStyle=rebar_style, rebarBarType=stirrup_rebar_bar_type, startHookOrientation=rebar_hook_orientation, endHookOrientation=rebar_hook_orientation, startHookType=rebar_hook_type, endHookType=rebar_hook_type, vector=ZAxis)
byCurve_3 = Rebar.ByCurve(curve=translate_2, hostElementId=id, rebarStyle=rebar_style, rebarBarType=stirrup_rebar_bar_type, startHookOrientation=rebar_hook_orientation, endHookOrientation=rebar_hook_orientation, startHookType=rebar_hook_type, endHookType=rebar_hook_type, vector=ZAxis)

# group: Distribution of Stirrup Rebar
setLayoutAsMaximumSpacing = StructuralDesign.Rebar.Layout.SetLayoutAsMaximumSpacing(rebar=byCurve, spacing=stirrup_spacing_at_end_of_column, arrayLength=length_of_stirrup_dist_at_end_of)
setLayoutAsMaximumSpacing_2 = StructuralDesign.Rebar.Layout.SetLayoutAsMaximumSpacing(rebar=byCurve_2, spacing=stirrup_spacing_at_end_of_column, arrayLength=length_of_stirrup_dist_at_end_of)
boolean = BoolSelector(false)
setLayoutAsMaximumSpacing_3 = StructuralDesign.Rebar.Layout.SetLayoutAsMaximumSpacing(rebar=byCurve_3, spacing=stirrup_spacing_in_middle_of, arrayLength=length_of_stirrup_dist_in_the, includeFirstBar=boolean, includeLastBar=boolean)

# group: Set Rebar Shape and Set as Solid in View
rebarShape = RevitRebarShape("M_T1")
setRebarShapeId = StructuralDesign.Rebar.Create.SetRebarShapeId(rebar=setLayoutAsMaximumSpacing, rebarShape=rebarShape.out1)
views = Views()  # nothing selected
setSolidInView = Custom[Rebar.SetSolidInView](rebarElements=setRebarShapeId, views=views)  # package BIM4Struc.Rebar; Sets this rebar element to be shown solidly in a 3D view.
setRebarShapeId_2 = StructuralDesign.Rebar.Create.SetRebarShapeId(rebar=setLayoutAsMaximumSpacing_2, rebarShape=rebarShape.out1)
setSolidInView_2 = Custom[Rebar.SetSolidInView](rebarElements=setRebarShapeId_2, views=views)
setRebarShapeId_3 = StructuralDesign.Rebar.Create.SetRebarShapeId(rebar=setLayoutAsMaximumSpacing_3, rebarShape=rebarShape.out1)
setSolidInView_3 = Custom[Rebar.SetSolidInView](rebarElements=setRebarShapeId_3, views=views)

# group: Vector Management
localCoordinateSystem = Custom[Element.LocalCoordinateSystem](element=select_model_element_by_category)  # package BIM4Struc.Productivity; Get the insertion point and local axes of an element.
reverse = Vector.Reverse(vector=localCoordinateSystem.Xvector)
reverse_2 = Vector.Reverse(vector=localCoordinateSystem.Yvector)

# group: Get Longitudinal Rebar Location at The Bottom Surface of Column
getBarDiameter = Custom[RebarType.GetBarDiameter](rebarBarType=stirrup_rebar_bar_type)  # package BIM4Struc.Rebar; Get the diameter of a given Rebar Bar Type
getBarDiameter_2 = Custom[RebarType.GetBarDiameter](rebarBarType=vertical_rebar_bar_type)
code_block_3 = CodeBlock(StirrupDia=getBarDiameter, LongDia=getBarDiameter_2) { -1*(StirrupDia+LongDia*0.5); }
offset_2 = Curve.Offset(curve=offset, distance=code_block_3)
byJoinedCurves_3 = PolyCurve.ByJoinedCurves(curves=offset_2@L1)
curves = PolyCurve.Curves(polyCurve=byJoinedCurves_3)
endPoints = Geometry.Curves.EndPoints(curve=curves)
byTwoPoints = Vector.ByTwoPoints(start=endPoints.StartPoint, end=endPoints.EndPoint)
isParallel = Vector.IsParallel(vector=localCoordinateSystem.Xvector, otherVector=byTwoPoints)
filterByBoolMask = List.FilterByBoolMask(list=curves, mask=isParallel)
curve_in_x_direction = CodeBlock(x=filterByBoolMask.in) { x; }

# group: Create Curve for Longitudinal Rebar
endPoints_2 = Geometry.Curves.EndPoints(curve=curve_in_x_direction)
firstItem = List.FirstItem(list=endPoints_2.StartPoint@L2)
ZAxis_2 = Vector.ZAxis()
code_block_4 = CodeBlock(ColumnLength=concreteBeamColumnCharacteristics.Length, ConcreteCover=concrete_cover) { ColumnLength-ConcreteCover; }
byStartPointDirectionLength = Line.ByStartPointDirectionLength(startPoint=firstItem, direction=ZAxis_2, length=code_block_4)
lastItem = List.LastItem(list=endPoints_2.StartPoint@L2)
byStartPointDirectionLength_2 = Line.ByStartPointDirectionLength(startPoint=lastItem, direction=ZAxis_2, length=code_block_4)

# group: Create Curve for Leg Length and Combine it with Longitudinal Rebar
endPoint = Curve.EndPoint(curve=byStartPointDirectionLength)
byStartPointDirectionLength_3 = Line.ByStartPointDirectionLength(startPoint=endPoint, direction=reverse, length=top_l_shape_leg_length)
list_create = List.Create(item0=byStartPointDirectionLength, item1=byStartPointDirectionLength_3)
transpose = List.Transpose(lists=list_create)
byJoinedCurves_4 = PolyCurve.ByJoinedCurves(curves=transpose)
endPoint_2 = Curve.EndPoint(curve=byStartPointDirectionLength_2)
byStartPointDirectionLength_4 = Line.ByStartPointDirectionLength(startPoint=endPoint_2, direction=reverse_2, length=top_l_shape_leg_length)
list_create_2 = List.Create(item0=byStartPointDirectionLength_2, item1=byStartPointDirectionLength_4)
transpose_2 = List.Transpose(lists=list_create_2)
byJoinedCurves_5 = PolyCurve.ByJoinedCurves(curves=transpose_2)
byStartPointDirectionLength_5 = Line.ByStartPointDirectionLength(startPoint=endPoint, direction=localCoordinateSystem.Yvector, length=top_l_shape_leg_length)
list_create_3 = List.Create(item0=byStartPointDirectionLength, item1=byStartPointDirectionLength_5)
transpose_3 = List.Transpose(lists=list_create_3)
byJoinedCurves_6 = PolyCurve.ByJoinedCurves(curves=transpose_3)
byStartPointDirectionLength_6 = Line.ByStartPointDirectionLength(startPoint=endPoint_2, direction=localCoordinateSystem.Xvector, length=top_l_shape_leg_length)
list_create_4 = List.Create(item0=byStartPointDirectionLength_2, item1=byStartPointDirectionLength_6)
transpose_4 = List.Transpose(lists=list_create_4)
byJoinedCurves_7 = PolyCurve.ByJoinedCurves(curves=transpose_4)

# group: Information to create longitudinal rebar
id_2 = Element.Id(element=select_model_element_by_category)
rebar_style_2 = RebarStyle("Standard", EnumerationType="Autodesk.Revit.DB.Structure.RebarStyle, RevitAPI, Version=23.0.0.0, Culture=neutral, PublicKeyToken=null")
rebar_hook_orientation_2 = RebarHookOrientation("Left", EnumerationType="Autodesk.Revit.DB.Structure.RebarHookOrientation, RevitAPI, Version=23.0.0.0, Culture=neutral, PublicKeyToken=null")
rebar_hook_type_2 = RevitRebarHookType("None", ElementType="Autodesk.Revit.DB.Structure.RebarHookType, RevitAPI, Version=23.0.0.0, Culture=neutral, PublicKeyToken=null")

# group: Calculate distribution length of longitudinal rebar
distribution_length_of_long = CodeBlock(height=getParameterValueByName_3, ColumnCover=concrete_cover, StirrupDia=getBarDiameter, LongDia=getBarDiameter_2) { height-2*ColumnCover-2*StirrupDia-LongDia; }  # "Distribution Length of Long. Rebar in Y Direction"
distribution_length_of_long_2 = CodeBlock(width=getParameterValueByName_4, ColumnCover=concrete_cover, StirrupDia=getBarDiameter, LongDia=getBarDiameter_2) { width-2*ColumnCover-2*StirrupDia-LongDia; }  # "Distribution Length of Long. Rebar in X Direction"

# group: Create Longitudinal Rebar in Y Direction
code_block_5 = CodeBlock(x=getParameterValueByName_2) { x+2; }
byCurve_4 = Rebar.ByCurve(curve=byJoinedCurves_4, hostElementId=id_2, rebarStyle=rebar_style_2, rebarBarType=vertical_rebar_bar_type, startHookOrientation=rebar_hook_orientation_2, endHookOrientation=rebar_hook_orientation_2, startHookType=rebar_hook_type_2, endHookType=rebar_hook_type_2, vector=localCoordinateSystem.Yvector)
code_block_6 = CodeBlock { 9; }
boolean_2 = BoolSelector(false)
setLayoutAsFixedNumber = StructuralDesign.Rebar.Layout.SetLayoutAsFixedNumber(rebar=byCurve_4, arrayLength=distribution_length_of_long, numberOfBarPositions=code_block_6, includeFirstBar=boolean_2, includeLastBar=boolean_2)
byCurve_5 = Rebar.ByCurve(curve=byJoinedCurves_7, hostElementId=id_2, rebarStyle=rebar_style_2, rebarBarType=vertical_rebar_bar_type, startHookOrientation=rebar_hook_orientation_2, endHookOrientation=rebar_hook_orientation_2, startHookType=rebar_hook_type_2, endHookType=rebar_hook_type_2, vector=reverse_2)
setLayoutAsFixedNumber_2 = StructuralDesign.Rebar.Layout.SetLayoutAsFixedNumber(rebar=byCurve_5, arrayLength=distribution_length_of_long, numberOfBarPositions=code_block_6, includeFirstBar=boolean_2, includeLastBar=boolean_2)

# group: Create Longitudinal Rebar in X Direction
byCurve_6 = Rebar.ByCurve(curve=byJoinedCurves_5, hostElementId=id_2, rebarStyle=rebar_style_2, rebarBarType=vertical_rebar_bar_type, startHookOrientation=rebar_hook_orientation_2, endHookOrientation=rebar_hook_orientation_2, startHookType=rebar_hook_type_2, endHookType=rebar_hook_type_2, vector=localCoordinateSystem.Xvector)
code_block_7 = CodeBlock { 4; }
setLayoutAsFixedNumber_3 = StructuralDesign.Rebar.Layout.SetLayoutAsFixedNumber(rebar=byCurve_6, arrayLength=distribution_length_of_long_2, numberOfBarPositions=code_block_7)
byCurve_7 = Rebar.ByCurve(curve=byJoinedCurves_6, hostElementId=id_2, rebarStyle=rebar_style_2, rebarBarType=vertical_rebar_bar_type, startHookOrientation=rebar_hook_orientation_2, endHookOrientation=rebar_hook_orientation_2, startHookType=rebar_hook_type_2, endHookType=rebar_hook_type_2, vector=reverse)
setLayoutAsFixedNumber_4 = StructuralDesign.Rebar.Layout.SetLayoutAsFixedNumber(rebar=byCurve_7, arrayLength=distribution_length_of_long_2, numberOfBarPositions=code_block_7)

# group: Set Rebar Shape and Set as Solid in View
rebarShape_2 = RevitRebarShape("M_17A")
setRebarShapeId_4 = StructuralDesign.Rebar.Create.SetRebarShapeId(rebar=setLayoutAsFixedNumber, rebarShape=rebarShape_2.out1)
views_2 = Views()  # nothing selected
setSolidInView_4 = Custom[Rebar.SetSolidInView](rebarElements=setRebarShapeId_4, views=views_2)
setRebarShapeId_5 = StructuralDesign.Rebar.Create.SetRebarShapeId(rebar=setLayoutAsFixedNumber_3, rebarShape=rebarShape_2.out1)
setSolidInView_5 = Custom[Rebar.SetSolidInView](rebarElements=setRebarShapeId_5, views=views_2)
setRebarShapeId_6 = StructuralDesign.Rebar.Create.SetRebarShapeId(rebar=setLayoutAsFixedNumber_4, rebarShape=rebarShape_2.out1)
setSolidInView_6 = Custom[Rebar.SetSolidInView](rebarElements=setRebarShapeId_6, views=views_2)
setRebarShapeId_7 = StructuralDesign.Rebar.Create.SetRebarShapeId(rebar=setLayoutAsFixedNumber_2, rebarShape=rebarShape_2.out1)
setSolidInView_7 = Custom[Rebar.SetSolidInView](rebarElements=setRebarShapeId_7, views=views_2, solid=views_2)
