# Dynamo graph Making Column Rebar with Lap Splice_26Sept2023.dyn (Dynamo 2.13.1.3887)
# packages: Clockwork for Dynamo 2.x 2.6.0, archi-lab.net 2023.213.1722, BIM4Struc.Productivity 2.2.2, Dynamo for Rebar 2.0.2, LunchBox for Dynamo 2017.10.2, BIM4Struc.Rebar 1.3.0, Structural Design 2023.4.25

# group: Inputs
select_model_element_by_category = DSModelElementByCategorySelection("OST_StructuralColumns")  # 1 picked in the model
concrete_cover = DoubleInput(40)
stirrup_rebar_bar_type = RebarBarType("10M", ElementType="Autodesk.Revit.DB.Structure.RebarBarType, RevitAPI, Version=23.0.0.0, Culture=neutral, PublicKeyToken=null")
longitudinal_rebar_bar_type = RebarBarType("22M", ElementType="Autodesk.Revit.DB.Structure.RebarBarType, RevitAPI, Version=23.0.0.0, Culture=neutral, PublicKeyToken=null")
select_model_element_by_category_2 = DSModelElementByCategorySelection("OST_StructuralFoundation")  # 1 picked in the model
special_length_rebar = DoubleInput(8000)
l_shape_leg_length = DoubleInput(300)
rebar_bar_type = RebarBarType("22M", ElementType="Autodesk.Revit.DB.Structure.RebarBarType, RevitAPI, Version=23.0.0.0, Culture=neutral, PublicKeyToken=null")
lap_splice_length = DoubleInput(1300)

# group: Obtain bottom surface of column
faces = Element.Faces(element=select_model_element_by_category)
code_block = CodeBlock { 1; }
flatten = List.Flatten(list=faces, amount=code_block)
filterByOrientation = Custom[Surface.FilterByOrientation](surfaces=flatten)  # package Clockwork for Dynamo 2.x; Sorts surfaces in three lists based on their orientation (vertical, horizontal up & horizontal down) and also returns three corresponding lists of booleans.

# group: Vector Management
localCoordinateSystem = Custom[Element.LocalCoordinateSystem](element=select_model_element_by_category_2)  # package BIM4Struc.Productivity; Get the insertion point and local axes of an element.
reverse = Vector.Reverse(vector=localCoordinateSystem.Yvector)
reverse_2 = Vector.Reverse(vector=localCoordinateSystem.Xvector)

type = archilab.Revit.Elements.Elements.Type(element=select_model_element_by_category_2)
code_block_2 = CodeBlock { "Foundation Thickness"; }
getParameterValueByName = Element.GetParameterValueByName(element=type, parameterName=code_block_2)
footing_cover = CodeBlock { 50; }
code_block_3 = CodeBlock(FoundationThickness=getParameterValueByName, FootingCover=footing_cover) { FoundationThickness-FootingCover-40; }

# group: Get longitudinal rebar location at bottom of foundation
getBarDiameter = Custom[RebarType.GetBarDiameter](rebarBarType=stirrup_rebar_bar_type)  # package BIM4Struc.Rebar; Get the diameter of a given Rebar Bar Type
getBarDiameter_2 = Custom[RebarType.GetBarDiameter](rebarBarType=longitudinal_rebar_bar_type)
code_block_4 = CodeBlock(StirrupDia=getBarDiameter, LongDia=getBarDiameter_2) { -1*(StirrupDia*0.5+LongDia*0.5); }
ZAxis = Vector.ZAxis()
reverse_3 = Vector.Reverse(vector=ZAxis)

# group: Calculate distribution length of longitudinal rebar
type_2 = archilab.Revit.Elements.Elements.Type(element=select_model_element_by_category)
code_block_5 = CodeBlock { "b"; "h"; "Bars Along b"; }
getParameterValueByName_2 = Element.GetParameterValueByName(element=type_2, parameterName=code_block_5.out2)
getParameterValueByName_3 = Element.GetParameterValueByName(element=type_2, parameterName=code_block_5.out0)
distribution_length_of_long = CodeBlock(width=getParameterValueByName_3, ColumnCover=concrete_cover, StirrupDia=getBarDiameter, LongDia=getBarDiameter_2) { width-2*ColumnCover-2*StirrupDia-LongDia; }  # "Distribution Length of Long. Rebar in X Direction"
getParameterValueByName_4 = Element.GetParameterValueByName(element=type_2, parameterName=code_block_5.out1)
distribution_length_of_long_2 = CodeBlock(depth=getParameterValueByName_4, ColumnCover=concrete_cover, StirrupDia=getBarDiameter, LongDia=getBarDiameter_2) { depth-2*ColumnCover-2*StirrupDia-LongDia; }  # "Distribution Length of Long. Rebar in Y Direction"

# group: Create stirrup curve for foundation
perimeterCurves = Surface.PerimeterCurves(surface=filterByOrientation.horizontalDown)
byJoinedCurves = PolyCurve.ByJoinedCurves(curves=perimeterCurves)
code_block_6 = CodeBlock(cover=concrete_cover, stirrupDia=getBarDiameter) { -1*(cover-0.5*stirrupDia); }
offset = Curve.Offset(curve=byJoinedCurves, distance=code_block_6)

# group (continued): Get longitudinal rebar location at bottom of foundation
offset_2 = Curve.Offset(curve=offset, distance=code_block_4)
byJoinedCurves_2 = PolyCurve.ByJoinedCurves(curves=offset_2@L1)
curves = PolyCurve.Curves(polyCurve=byJoinedCurves_2)
endPoints = Geometry.Curves.EndPoints(curve=curves)
byTwoPoints = Vector.ByTwoPoints(start=endPoints.StartPoint, end=endPoints.EndPoint)
isParallel = Vector.IsParallel(vector=localCoordinateSystem.Xvector, otherVector=byTwoPoints)
filterByBoolMask = List.FilterByBoolMask(list=curves, mask=isParallel)
curve_in_x_direction = CodeBlock(x=filterByBoolMask.in) { x; }
translate = Geometry.Translate(geometry=curve_in_x_direction, direction=reverse_3, distance=code_block_3)

concreteBeamColumnCharacteristics = StructuralDesign.Model.Opening.Geometry.ConcreteBeamColumnCharacteristics(element=select_model_element_by_category)

# group: Create curve for longitudinal rebar
endPoints_2 = Geometry.Curves.EndPoints(curve=translate)
firstItem = List.FirstItem(list=endPoints_2.StartPoint@L2)
ZAxis_2 = Vector.ZAxis()
anchorage_length_to_foundation = CodeBlock(AnchorageLength=code_block_3, ColumnLength=concreteBeamColumnCharacteristics.Length, Cover=concrete_cover) { AnchorageLength+ColumnLength-Cover; }  # "Anchorage Length to Foundation + Lap Splice"
byStartPointDirectionLength = Line.ByStartPointDirectionLength(startPoint=firstItem, direction=ZAxis_2, length=anchorage_length_to_foundation)
lastItem = List.LastItem(list=endPoints_2.StartPoint@L2)
byStartPointDirectionLength_2 = Line.ByStartPointDirectionLength(startPoint=lastItem, direction=ZAxis_2, length=anchorage_length_to_foundation)

# group: Script for special length and lap splice length implementation of column
# Rebar yang di bawah. yang bakal jd dowel bar
code_block_7 = CodeBlock(SpL=special_length_rebar, HookLength=l_shape_leg_length) { SpL-HookLength; }
pointAtSegmentLength = Curve.PointAtSegmentLength(curve=byStartPointDirectionLength, segmentLength=code_block_7)
splitByPoints = Curve.SplitByPoints(curve=byStartPointDirectionLength, points=pointAtSegmentLength)
firstItem_2 = List.FirstItem(list=splitByPoints@L2)
startPoint = Curve.StartPoint(curve=firstItem_2)
endPoint = Curve.EndPoint(curve=firstItem_2)
byStartPointEndPoint = Line.ByStartPointEndPoint(startPoint=startPoint, endPoint=endPoint)
# note: First item which will be distributed in X direction
byStartPointDirectionLength_3 = Line.ByStartPointDirectionLength(startPoint=startPoint, direction=reverse, length=l_shape_leg_length)
list_create = List.Create(item0=byStartPointEndPoint, item1=byStartPointDirectionLength_3)
transpose = List.Transpose(lists=list_create)
byJoinedCurves_3 = PolyCurve.ByJoinedCurves(curves=transpose)
# note: First item which will be distributed in Y direction
byStartPointDirectionLength_4 = Line.ByStartPointDirectionLength(startPoint=startPoint, direction=localCoordinateSystem.Xvector, length=l_shape_leg_length)
list_create_2 = List.Create(item0=byStartPointEndPoint, item1=byStartPointDirectionLength_4)
transpose_2 = List.Transpose(lists=list_create_2)
byJoinedCurves_4 = PolyCurve.ByJoinedCurves(curves=transpose_2)

# group: Information to create longitudinal rebar
id = Element.Id(element=select_model_element_by_category_2)
rebar_style = RebarStyle("Standard", EnumerationType="Autodesk.Revit.DB.Structure.RebarStyle, RevitAPI, Version=23.0.0.0, Culture=neutral, PublicKeyToken=null")
rebar_hook_orientation = RebarHookOrientation("Right", EnumerationType="Autodesk.Revit.DB.Structure.RebarHookOrientation, RevitAPI, Version=23.0.0.0, Culture=neutral, PublicKeyToken=null")
rebar_hook_type = RevitRebarHookType("None", ElementType="Autodesk.Revit.DB.Structure.RebarHookType, RevitAPI, Version=23.0.0.0, Culture=neutral, PublicKeyToken=null")

byCurve = Rebar.ByCurve(curve=byJoinedCurves_3, hostElementId=id, rebarStyle=rebar_style, rebarBarType=rebar_bar_type, startHookOrientation=rebar_hook_orientation, endHookOrientation=rebar_hook_orientation, startHookType=rebar_hook_type, endHookType=rebar_hook_type, vector=reverse_2)
code_block_8 = CodeBlock { 4; }
setLayoutAsFixedNumber = StructuralDesign.Rebar.Layout.SetLayoutAsFixedNumber(rebar=byCurve, arrayLength=distribution_length_of_long, numberOfBarPositions=code_block_8)
byCurve_2 = Rebar.ByCurve(curve=byJoinedCurves_4, hostElementId=id, rebarStyle=rebar_style, rebarBarType=rebar_bar_type, startHookOrientation=rebar_hook_orientation, endHookOrientation=rebar_hook_orientation, startHookType=rebar_hook_type, endHookType=rebar_hook_type, vector=localCoordinateSystem.Yvector)
total_rebar = CodeBlock { 18; }
code_block_9 = CodeBlock(TotalRebar=total_rebar, BarsAlongB=code_block_8) { 0.5*(TotalRebar-2*BarsAlongB)+2; }
boolean = BoolSelector(false)
setLayoutAsFixedNumber_2 = StructuralDesign.Rebar.Layout.SetLayoutAsFixedNumber(rebar=byCurve_2, arrayLength=distribution_length_of_long_2, numberOfBarPositions=code_block_9, includeFirstBar=boolean, includeLastBar=boolean)

# group: Script for special length and lap splice length implementation of column
YAxis = Vector.YAxis()
rebar_movement = DoubleInput(22)
translate_2 = Geometry.Translate(geometry=byStartPointDirectionLength, direction=YAxis, distance=rebar_movement)
code_block_10 = CodeBlock(FirstRebar=code_block_7, LapSpliceLength=lap_splice_length) { FirstRebar-LapSpliceLength; }
pointAtSegmentLength_2 = Curve.PointAtSegmentLength(curve=translate_2, segmentLength=code_block_10)
splitByPoints_2 = Curve.SplitByPoints(curve=translate_2, points=pointAtSegmentLength_2)
lastItem_2 = List.LastItem(list=splitByPoints_2@L2)
startPoint_2 = Curve.StartPoint(curve=lastItem_2)
endPoint_2 = Curve.EndPoint(curve=lastItem_2)
byStartPointEndPoint_2 = Line.ByStartPointEndPoint(startPoint=startPoint_2, endPoint=endPoint_2)
# note: First item which will be distributed in Y direction
byStartPointDirectionLength_5 = Line.ByStartPointDirectionLength(startPoint=endPoint_2, direction=reverse_2, length=l_shape_leg_length)
list_create_3 = List.Create(item0=byStartPointEndPoint_2, item1=byStartPointDirectionLength_5)
transpose_3 = List.Transpose(lists=list_create_3)
byJoinedCurves_5 = PolyCurve.ByJoinedCurves(curves=transpose_3)
translate_3 = Geometry.Translate(geometry=byStartPointDirectionLength, direction=YAxis, distance=rebar_movement)
pointAtSegmentLength_3 = Curve.PointAtSegmentLength(curve=translate_3, segmentLength=code_block_10)
splitByPoints_3 = Curve.SplitByPoints(curve=translate_3, points=pointAtSegmentLength_3)
lastItem_3 = List.LastItem(list=splitByPoints_3@L2)
startPoint_3 = Curve.StartPoint(curve=lastItem_3)
endPoint_3 = Curve.EndPoint(curve=lastItem_3)
byStartPointEndPoint_3 = Line.ByStartPointEndPoint(startPoint=startPoint_3, endPoint=endPoint_3)
# note: First item which will be distributed in X direction
byStartPointDirectionLength_6 = Line.ByStartPointDirectionLength(startPoint=endPoint_3, direction=localCoordinateSystem.Yvector, length=l_shape_leg_length)
list_create_4 = List.Create(item0=byStartPointEndPoint_3, item1=byStartPointDirectionLength_6)
transpose_4 = List.Transpose(lists=list_create_4)
byJoinedCurves_6 = PolyCurve.ByJoinedCurves(curves=transpose_4)

byCurve_3 = Rebar.ByCurve(curve=byJoinedCurves_5, hostElementId=id, rebarStyle=rebar_style, rebarBarType=rebar_bar_type, startHookOrientation=rebar_hook_orientation, endHookOrientation=rebar_hook_orientation, startHookType=rebar_hook_type, endHookType=rebar_hook_type, vector=localCoordinateSystem.Yvector)
setLayoutAsFixedNumber_3 = StructuralDesign.Rebar.Layout.SetLayoutAsFixedNumber(rebar=byCurve_3, arrayLength=distribution_length_of_long_2, numberOfBarPositions=code_block_9, includeFirstBar=boolean, includeLastBar=boolean)
byCurve_4 = Rebar.ByCurve(curve=byJoinedCurves_6, hostElementId=id, rebarStyle=rebar_style, rebarBarType=rebar_bar_type, startHookOrientation=rebar_hook_orientation, endHookOrientation=rebar_hook_orientation, startHookType=rebar_hook_type, endHookType=rebar_hook_type, vector=reverse_2)
setLayoutAsFixedNumber_4 = StructuralDesign.Rebar.Layout.SetLayoutAsFixedNumber(rebar=byCurve_4, arrayLength=distribution_length_of_long, numberOfBarPositions=code_block_8)

# group: Script for special length and lap splice length implementation of column
code_block_11 = CodeBlock(SpL=special_length_rebar, HookLength=l_shape_leg_length) { SpL-HookLength; }
pointAtSegmentLength_4 = Curve.PointAtSegmentLength(curve=byStartPointDirectionLength_2, segmentLength=code_block_11)
splitByPoints_4 = Curve.SplitByPoints(curve=byStartPointDirectionLength_2, points=pointAtSegmentLength_4)
firstItem_3 = List.FirstItem(list=splitByPoints_4@L2)
startPoint_4 = Curve.StartPoint(curve=firstItem_3)
endPoint_4 = Curve.EndPoint(curve=firstItem_3)
byStartPointEndPoint_4 = Line.ByStartPointEndPoint(startPoint=startPoint_4, endPoint=endPoint_4)
# note: First item which will be distributed in Y direction
byStartPointDirectionLength_7 = Line.ByStartPointDirectionLength(startPoint=startPoint_4, direction=reverse_2, length=l_shape_leg_length)
list_create_5 = List.Create(item0=byStartPointEndPoint_4, item1=byStartPointDirectionLength_7)
transpose_5 = List.Transpose(lists=list_create_5)
byJoinedCurves_7 = PolyCurve.ByJoinedCurves(curves=transpose_5)
# note: First item which will be distributed in X direction
byStartPointDirectionLength_8 = Line.ByStartPointDirectionLength(startPoint=startPoint_4, direction=localCoordinateSystem.Yvector, length=l_shape_leg_length)
list_create_6 = List.Create(item0=byStartPointEndPoint_4, item1=byStartPointDirectionLength_8)
transpose_6 = List.Transpose(lists=list_create_6)
byJoinedCurves_8 = PolyCurve.ByJoinedCurves(curves=transpose_6)

byCurve_5 = Rebar.ByCurve(curve=byJoinedCurves_7, hostElementId=id, rebarStyle=rebar_style, rebarBarType=rebar_bar_type, startHookOrientation=rebar_hook_orientation, endHookOrientation=rebar_hook_orientation, startHookType=rebar_hook_type, endHookType=rebar_hook_type, vector=reverse)
setLayoutAsFixedNumber_5 = StructuralDesign.Rebar.Layout.SetLayoutAsFixedNumber(rebar=byCurve_5, arrayLength=distribution_length_of_long_2, numberOfBarPositions=code_block_9, includeFirstBar=boolean, includeLastBar=boolean)
byCurve_6 = Rebar.ByCurve(curve=byJoinedCurves_8, hostElementId=id, rebarStyle=rebar_style, rebarBarType=rebar_bar_type, startHookOrientation=rebar_hook_orientation, endHookOrientation=rebar_hook_orientation, startHookType=rebar_hook_type, endHookType=rebar_hook_type, vector=localCoordinateSystem.Xvector)
setLayoutAsFixedNumber_6 = StructuralDesign.Rebar.Layout.SetLayoutAsFixedNumber(rebar=byCurve_6, arrayLength=distribution_length_of_long, numberOfBarPositions=code_block_8)

# group: Script for special length and lap splice length implementation of column
YAxis_2 = Vector.YAxis()
rebar_movement_2 = DoubleInput(22)
translate_4 = Geometry.Translate(geometry=byStartPointDirectionLength_2, direction=YAxis_2, distance=rebar_movement_2)
code_block_12 = CodeBlock(FirstRebar=code_block_7, LapSpliceLength=lap_splice_length) { FirstRebar-LapSpliceLength; }
pointAtSegmentLength_5 = Curve.PointAtSegmentLength(curve=translate_4, segmentLength=code_block_12)
splitByPoints_5 = Curve.SplitByPoints(curve=translate_4, points=pointAtSegmentLength_5)
lastItem_4 = List.LastItem(list=splitByPoints_5@L2)
startPoint_5 = Curve.StartPoint(curve=lastItem_4)
endPoint_5 = Curve.EndPoint(curve=lastItem_4)
byStartPointEndPoint_5 = Line.ByStartPointEndPoint(startPoint=startPoint_5, endPoint=endPoint_5)
# note: Last item which will be distributed in X direction
byStartPointDirectionLength_9 = Line.ByStartPointDirectionLength(startPoint=endPoint_5, direction=reverse, length=l_shape_leg_length)
list_create_7 = List.Create(item0=byStartPointEndPoint_5, item1=byStartPointDirectionLength_9)
transpose_7 = List.Transpose(lists=list_create_7)
byJoinedCurves_9 = PolyCurve.ByJoinedCurves(curves=transpose_7)
translate_5 = Geometry.Translate(geometry=byStartPointDirectionLength_2, direction=YAxis_2, distance=rebar_movement_2)
pointAtSegmentLength_6 = Curve.PointAtSegmentLength(curve=translate_5, segmentLength=code_block_12)
splitByPoints_6 = Curve.SplitByPoints(curve=translate_5, points=pointAtSegmentLength_6)
lastItem_5 = List.LastItem(list=splitByPoints_6@L2)
startPoint_6 = Curve.StartPoint(curve=lastItem_5)
endPoint_6 = Curve.EndPoint(curve=lastItem_5)
byStartPointEndPoint_6 = Line.ByStartPointEndPoint(startPoint=startPoint_6, endPoint=endPoint_6)
# note: Last item which will be distributed in Y direction
byStartPointDirectionLength_10 = Line.ByStartPointDirectionLength(startPoint=endPoint_6, direction=localCoordinateSystem.Xvector, length=l_shape_leg_length)
list_create_8 = List.Create(item0=byStartPointEndPoint_6, item1=byStartPointDirectionLength_10)
transpose_8 = List.Transpose(lists=list_create_8)
byJoinedCurves_10 = PolyCurve.ByJoinedCurves(curves=transpose_8)

byCurve_7 = Rebar.ByCurve(curve=byJoinedCurves_9, hostElementId=id, rebarStyle=rebar_style, rebarBarType=rebar_bar_type, startHookOrientation=rebar_hook_orientation, endHookOrientation=rebar_hook_orientation, startHookType=rebar_hook_type, endHookType=rebar_hook_type, vector=localCoordinateSystem.Xvector)
setLayoutAsFixedNumber_7 = StructuralDesign.Rebar.Layout.SetLayoutAsFixedNumber(rebar=byCurve_7, arrayLength=distribution_length_of_long, numberOfBarPositions=code_block_8)
byCurve_8 = Rebar.ByCurve(curve=byJoinedCurves_10, hostElementId=id, rebarStyle=rebar_style, rebarBarType=rebar_bar_type, startHookOrientation=rebar_hook_orientation, endHookOrientation=rebar_hook_orientation, startHookType=rebar_hook_type, endHookType=rebar_hook_type, vector=reverse)
setLayoutAsFixedNumber_8 = StructuralDesign.Rebar.Layout.SetLayoutAsFixedNumber(rebar=byCurve_8, arrayLength=distribution_length_of_long_2, numberOfBarPositions=code_block_9, includeFirstBar=boolean, includeLastBar=boolean)
