# Dynamo graph Making Slab Rebar With Lap Splice_26Sept2023.dyn (Dynamo 2.13.1.3887)
# packages: Dynamo for Rebar 2.0.2, Structural Design 2023.4.25

# group: Inputs
select_face_y_plane = DSFaceSelection()  # 1 picked in the model
select_face_x_plane = DSFaceSelection()  # 1 picked in the model
concrete_cover = DoubleInput(40)
hook_length = DoubleInput(100)
select_model_element = DSModelElementSelection()  # 1 picked in the model
slab_rebar_bar_type = RebarBarType("10M", ElementType="Autodesk.Revit.DB.Structure.RebarBarType, RevitAPI, Version=23.0.0.0, Culture=neutral, PublicKeyToken=null")
slab_rebar_spacing = DoubleInput(400)

# group: Information of YZ-Plane
perimeterCurves = Surface.PerimeterCurves(surface=select_face_y_plane)
startPoint = Curve.StartPoint(curve=perimeterCurves)
byCornerPoints = Rectangle.ByCornerPoints(points=startPoint)
width = Rectangle.Width(rectangle=byCornerPoints)
height = Rectangle.Height(rectangle=byCornerPoints)

# group: Create Main Curve of Slab Rebar in XZ-Plane to Y-Direction
perimeterCurves_2 = Surface.PerimeterCurves(surface=select_face_x_plane)
byJoinedCurves = PolyCurve.ByJoinedCurves(curves=perimeterCurves_2)
code_block = CodeBlock(ConcreteCover=concrete_cover) { ConcreteCover*-1; }
offset = Curve.Offset(curve=byJoinedCurves, distance=code_block)
byJoinedCurves_2 = PolyCurve.ByJoinedCurves(curves=offset@L1)
curves = PolyCurve.Curves(polyCurve=byJoinedCurves_2)
startPoint_2 = Curve.StartPoint(curve=curves@L1)
YAxis = Vector.YAxis()
code_block_2 = CodeBlock(YPlaneWidth=height, ConcreteCover=concrete_cover) { YPlaneWidth-ConcreteCover; }
firstItem = List.FirstItem(list=startPoint_2@L2)
byStartPointDirectionLength = Line.ByStartPointDirectionLength(startPoint=firstItem, direction=YAxis, length=code_block_2)
XAxis = Vector.XAxis()
number = DoubleInput(20)
translate = Geometry.Translate(geometry=byStartPointDirectionLength, direction=XAxis, distance=number)

lastItem = List.LastItem(list=startPoint_2@L2)
byStartPointDirectionLength_2 = Line.ByStartPointDirectionLength(startPoint=lastItem, direction=YAxis, length=code_block_2)  # frozen

# group: Create Curve for Hook Length and Combine It with Main Slab Rebar
startPoint_3 = Curve.StartPoint(curve=byStartPointDirectionLength_2)  # frozen
ZAxis = Vector.ZAxis()
reverse = Vector.Reverse(vector=ZAxis)
byStartPointDirectionLength_3 = Line.ByStartPointDirectionLength(startPoint=startPoint_3, direction=reverse, length=hook_length)
endPoint = Curve.EndPoint(curve=byStartPointDirectionLength_2)  # frozen
byStartPointDirectionLength_4 = Line.ByStartPointDirectionLength(startPoint=endPoint, direction=reverse, length=hook_length)
list_create = List.Create(item0=byStartPointDirectionLength_3, item1=byStartPointDirectionLength_2, item2=byStartPointDirectionLength_4)
transpose = List.Transpose(lists=list_create)
byJoinedCurves_3 = PolyCurve.ByJoinedCurves(curves=transpose)
startPoint_4 = Curve.StartPoint(curve=byStartPointDirectionLength)  # frozen
byStartPointDirectionLength_5 = Line.ByStartPointDirectionLength(startPoint=startPoint_4, direction=ZAxis, length=hook_length)
endPoint_2 = Curve.EndPoint(curve=byStartPointDirectionLength)  # frozen
byStartPointDirectionLength_6 = Line.ByStartPointDirectionLength(startPoint=endPoint_2, direction=ZAxis, length=hook_length)
list_create_2 = List.Create(item0=byStartPointDirectionLength_5, item1=byStartPointDirectionLength, item2=byStartPointDirectionLength_6)
transpose_2 = List.Transpose(lists=list_create_2)
byJoinedCurves_4 = PolyCurve.ByJoinedCurves(curves=transpose_2)

# group: Information to create slab rebar
id = Element.Id(element=select_model_element)
rebar_style = RebarStyle("Standard", EnumerationType="Autodesk.Revit.DB.Structure.RebarStyle, RevitAPI, Version=23.0.0.0, Culture=neutral, PublicKeyToken=null")
rebar_hook_orientation = RebarHookOrientation("Right", EnumerationType="Autodesk.Revit.DB.Structure.RebarHookOrientation, RevitAPI, Version=23.0.0.0, Culture=neutral, PublicKeyToken=null")
rebar_hook_type = RevitRebarHookType("None", ElementType="Autodesk.Revit.DB.Structure.RebarHookType, RevitAPI, Version=23.0.0.0, Culture=neutral, PublicKeyToken=null")
XAxis_2 = Vector.XAxis()

# group: Information of XZ-Plane
perimeterCurves_3 = Surface.PerimeterCurves(surface=select_face_x_plane)
startPoint_5 = Curve.StartPoint(curve=perimeterCurves_3)
byCornerPoints_2 = Rectangle.ByCornerPoints(points=startPoint_5)
height_2 = Rectangle.Height(rectangle=byCornerPoints_2)
width_2 = Rectangle.Width(rectangle=byCornerPoints_2)

rebar_dist_length_in_x_plane = CodeBlock(XPlaneLength=height_2, cover=concrete_cover) { XPlaneLength-2*cover; }

# group: Create and Distribute Rebar in X-Direction
byCurve = Rebar.ByCurve(curve=byJoinedCurves_3, hostElementId=id, rebarStyle=rebar_style, rebarBarType=slab_rebar_bar_type, startHookOrientation=rebar_hook_orientation, endHookOrientation=rebar_hook_orientation, startHookType=rebar_hook_type, endHookType=rebar_hook_type, vector=XAxis_2)
setLayoutAsMaximumSpacing = StructuralDesign.Rebar.Layout.SetLayoutAsMaximumSpacing(rebar=byCurve, spacing=slab_rebar_spacing, arrayLength=rebar_dist_length_in_x_plane)
byCurve_2 = Rebar.ByCurve(curve=byJoinedCurves_4, hostElementId=id, rebarStyle=rebar_style, rebarBarType=slab_rebar_bar_type, startHookOrientation=rebar_hook_orientation, endHookOrientation=rebar_hook_orientation, startHookType=rebar_hook_type, endHookType=rebar_hook_type, vector=XAxis_2)
setLayoutAsMaximumSpacing_2 = StructuralDesign.Rebar.Layout.SetLayoutAsMaximumSpacing(rebar=byCurve_2, spacing=slab_rebar_spacing, arrayLength=rebar_dist_length_in_x_plane)

# group: Create Main Curve of Slab Rebar in YZ-Plane to X-Direction
perimeterCurves_4 = Surface.PerimeterCurves(surface=select_face_y_plane)
byJoinedCurves_5 = PolyCurve.ByJoinedCurves(curves=perimeterCurves_4)
code_block_3 = CodeBlock(ConcreteCover=concrete_cover) { ConcreteCover*-1; }
offset_2 = Curve.Offset(curve=byJoinedCurves_5, distance=code_block_3)
byJoinedCurves_6 = PolyCurve.ByJoinedCurves(curves=offset_2@L1)
curves_2 = PolyCurve.Curves(polyCurve=byJoinedCurves_6)
startPoint_6 = Curve.StartPoint(curve=curves_2@L1)
XAxis_3 = Vector.XAxis()
code_block_4 = CodeBlock(XPlaneWidth=height_2, ConcreteCover=concrete_cover) { XPlaneWidth-ConcreteCover; }
firstItem_2 = List.FirstItem(list=startPoint_6@L2)
byStartPointDirectionLength_7 = Line.ByStartPointDirectionLength(startPoint=firstItem_2, direction=XAxis_3, length=code_block_4)
YAxis_2 = Vector.YAxis()
number_2 = DoubleInput(20)
translate_2 = Geometry.Translate(geometry=byStartPointDirectionLength_7, direction=YAxis_2, distance=number_2)

lastItem_2 = List.LastItem(list=startPoint_6@L2)
byStartPointDirectionLength_8 = Line.ByStartPointDirectionLength(startPoint=lastItem_2, direction=XAxis_3, length=code_block_4)  # frozen

# group: Create Curve for Hook Length and Combine It with Main Slab Rebar
startPoint_7 = Curve.StartPoint(curve=byStartPointDirectionLength_8)
ZAxis_2 = Vector.ZAxis()
reverse_2 = Vector.Reverse(vector=ZAxis_2)
byStartPointDirectionLength_9 = Line.ByStartPointDirectionLength(startPoint=startPoint_7, direction=reverse_2, length=hook_length)
endPoint_3 = Curve.EndPoint(curve=byStartPointDirectionLength_8)
byStartPointDirectionLength_10 = Line.ByStartPointDirectionLength(startPoint=endPoint_3, direction=reverse_2, length=hook_length)
list_create_3 = List.Create(item0=byStartPointDirectionLength_9, item1=byStartPointDirectionLength_8, item2=byStartPointDirectionLength_10)
transpose_3 = List.Transpose(lists=list_create_3)
byJoinedCurves_7 = PolyCurve.ByJoinedCurves(curves=transpose_3)
startPoint_8 = Curve.StartPoint(curve=byStartPointDirectionLength_7)
byStartPointDirectionLength_11 = Line.ByStartPointDirectionLength(startPoint=startPoint_8, direction=ZAxis_2, length=hook_length)  # frozen
endPoint_4 = Curve.EndPoint(curve=byStartPointDirectionLength_7)
byStartPointDirectionLength_12 = Line.ByStartPointDirectionLength(startPoint=endPoint_4, direction=ZAxis_2, length=hook_length)  # frozen
list_create_4 = List.Create(item0=byStartPointDirectionLength_11, item1=byStartPointDirectionLength_7, item2=byStartPointDirectionLength_12)
transpose_4 = List.Transpose(lists=list_create_4)
byJoinedCurves_8 = PolyCurve.ByJoinedCurves(curves=transpose_4)

# group: Information to create slab rebar
id_2 = Element.Id(element=select_model_element)
rebar_style_2 = RebarStyle("Standard", EnumerationType="Autodesk.Revit.DB.Structure.RebarStyle, RevitAPI, Version=23.0.0.0, Culture=neutral, PublicKeyToken=null")
rebar_hook_orientation_2 = RebarHookOrientation("Right", EnumerationType="Autodesk.Revit.DB.Structure.RebarHookOrientation, RevitAPI, Version=23.0.0.0, Culture=neutral, PublicKeyToken=null")
rebar_hook_type_2 = RevitRebarHookType("None", ElementType="Autodesk.Revit.DB.Structure.RebarHookType, RevitAPI, Version=23.0.0.0, Culture=neutral, PublicKeyToken=null")
YAxis_3 = Vector.YAxis()
reverse_3 = Vector.Reverse(vector=YAxis_3)

rebar_dist_length_in_x_plane_2 = CodeBlock(YPlaneLength=height, cover=concrete_cover) { YPlaneLength-2*cover; }

# group: Create and Distribute Rebar in Y-Direction
byCurve_3 = Rebar.ByCurve(curve=byJoinedCurves_7, hostElementId=id_2, rebarStyle=rebar_style_2, rebarBarType=slab_rebar_bar_type, startHookOrientation=rebar_hook_orientation_2, endHookOrientation=rebar_hook_orientation_2, startHookType=rebar_hook_type_2, endHookType=rebar_hook_type_2, vector=reverse_3)
setLayoutAsMaximumSpacing_3 = StructuralDesign.Rebar.Layout.SetLayoutAsMaximumSpacing(rebar=byCurve_3, spacing=slab_rebar_spacing, arrayLength=rebar_dist_length_in_x_plane_2)
byCurve_4 = Rebar.ByCurve(curve=byJoinedCurves_8, hostElementId=id_2, rebarStyle=rebar_style_2, rebarBarType=slab_rebar_bar_type, startHookOrientation=rebar_hook_orientation_2, endHookOrientation=rebar_hook_orientation_2, startHookType=rebar_hook_type_2, endHookType=rebar_hook_type_2, vector=reverse_3)
setLayoutAsMaximumSpacing_4 = StructuralDesign.Rebar.Layout.SetLayoutAsMaximumSpacing(rebar=byCurve_4, spacing=slab_rebar_spacing, arrayLength=rebar_dist_length_in_x_plane_2)

special_length_rebar = DoubleInput(8000)

# group: Script for special length and lap splice length implementation of slab
first_rebar = CodeBlock(SpL=special_length_rebar, HookLength=hook_length) { SpL-HookLength; }
pointAtSegmentLength = Curve.PointAtSegmentLength(curve=byStartPointDirectionLength, segmentLength=first_rebar)
splitByPoints = Curve.SplitByPoints(curve=byStartPointDirectionLength, points=pointAtSegmentLength)
firstItem_3 = List.FirstItem(list=splitByPoints@L2)
startPoint_9 = Curve.StartPoint(curve=firstItem_3)
ZAxis_3 = Vector.ZAxis()
byStartPointDirectionLength_13 = Line.ByStartPointDirectionLength(startPoint=startPoint_9, direction=ZAxis_3, length=hook_length)
endPoint_5 = Curve.EndPoint(curve=firstItem_3)
byStartPointEndPoint = Line.ByStartPointEndPoint(startPoint=startPoint_9, endPoint=endPoint_5)
list_create_5 = List.Create(item0=byStartPointDirectionLength_13, item1=byStartPointEndPoint)
transpose_5 = List.Transpose(lists=list_create_5)
byJoinedCurves_9 = PolyCurve.ByJoinedCurves(curves=transpose_5)

# group: Information to create slab rebar
id_3 = Element.Id(element=select_model_element)
rebar_style_3 = RebarStyle("Standard", EnumerationType="Autodesk.Revit.DB.Structure.RebarStyle, RevitAPI, Version=23.0.0.0, Culture=neutral, PublicKeyToken=null")
rebar_hook_orientation_3 = RebarHookOrientation("Right", EnumerationType="Autodesk.Revit.DB.Structure.RebarHookOrientation, RevitAPI, Version=23.0.0.0, Culture=neutral, PublicKeyToken=null")
rebar_hook_type_3 = RevitRebarHookType("None", ElementType="Autodesk.Revit.DB.Structure.RebarHookType, RevitAPI, Version=23.0.0.0, Culture=neutral, PublicKeyToken=null")
XAxis_4 = Vector.XAxis()

byCurve_5 = Rebar.ByCurve(curve=byJoinedCurves_9, hostElementId=id_3, rebarStyle=rebar_style_3, rebarBarType=slab_rebar_bar_type, startHookOrientation=rebar_hook_orientation_3, endHookOrientation=rebar_hook_orientation_3, startHookType=rebar_hook_type_3, endHookType=rebar_hook_type_3, vector=XAxis_4)
setLayoutAsMaximumSpacing_5 = StructuralDesign.Rebar.Layout.SetLayoutAsMaximumSpacing(rebar=byCurve_5, spacing=slab_rebar_spacing, arrayLength=rebar_dist_length_in_x_plane)
lap_splice_length = DoubleInput(1300)

# group: Script for special length and lap splice length implementation of slab
code_block_5 = CodeBlock(FirstRebar=first_rebar, LapSpliceLength=lap_splice_length) { FirstRebar-LapSpliceLength; }
pointAtSegmentLength_2 = Curve.PointAtSegmentLength(curve=translate, segmentLength=code_block_5)
splitByPoints_2 = Curve.SplitByPoints(curve=translate, points=pointAtSegmentLength_2)
lastItem_3 = List.LastItem(list=splitByPoints_2@L2)
startPoint_10 = Curve.StartPoint(curve=lastItem_3)
endPoint_6 = Curve.EndPoint(curve=lastItem_3)
byStartPointEndPoint_2 = Line.ByStartPointEndPoint(startPoint=startPoint_10, endPoint=endPoint_6)
byStartPointDirectionLength_14 = Line.ByStartPointDirectionLength(startPoint=endPoint_6, direction=ZAxis_3, length=hook_length)
list_create_6 = List.Create(item0=byStartPointEndPoint_2, item1=byStartPointDirectionLength_14)
transpose_6 = List.Transpose(lists=list_create_6)
byJoinedCurves_10 = PolyCurve.ByJoinedCurves(curves=transpose_6)

byCurve_6 = Rebar.ByCurve(curve=byJoinedCurves_10, hostElementId=id_3, rebarStyle=rebar_style_3, rebarBarType=slab_rebar_bar_type, startHookOrientation=rebar_hook_orientation_3, endHookOrientation=rebar_hook_orientation_3, startHookType=rebar_hook_type_3, endHookType=rebar_hook_type_3, vector=XAxis_4)
setLayoutAsMaximumSpacing_6 = StructuralDesign.Rebar.Layout.SetLayoutAsMaximumSpacing(rebar=byCurve_6, spacing=slab_rebar_spacing, arrayLength=rebar_dist_length_in_x_plane)
code_block_6 = CodeBlock(FirstRebar=first_rebar, LapSpliceLength=lap_splice_length) { FirstRebar-LapSpliceLength; }
pointAtSegmentLength_3 = Curve.PointAtSegmentLength(curve=translate_2, segmentLength=code_block_6)
splitByPoints_3 = Curve.SplitByPoints(curve=translate_2, points=pointAtSegmentLength_3)
lastItem_4 = List.LastItem(list=splitByPoints_3@L2)
startPoint_11 = Curve.StartPoint(curve=lastItem_4)
endPoint_7 = Curve.EndPoint(curve=lastItem_4)
byStartPointEndPoint_3 = Line.ByStartPointEndPoint(startPoint=startPoint_11, endPoint=endPoint_7)
pointAtSegmentLength_4 = Curve.PointAtSegmentLength(curve=byStartPointEndPoint_3, segmentLength=special_length_rebar)
splitByPoints_4 = Curve.SplitByPoints(curve=byStartPointEndPoint_3, points=pointAtSegmentLength_4)
firstItem_4 = List.FirstItem(list=splitByPoints_4@L2)
startPoint_12 = Curve.StartPoint(curve=firstItem_4)
endPoint_8 = Curve.EndPoint(curve=firstItem_4)
byStartPointEndPoint_4 = Line.ByStartPointEndPoint(startPoint=startPoint_12, endPoint=endPoint_8)

# group: Information to create slab rebar
id_4 = Element.Id(element=select_model_element)
rebar_style_4 = RebarStyle("Standard", EnumerationType="Autodesk.Revit.DB.Structure.RebarStyle, RevitAPI, Version=23.0.0.0, Culture=neutral, PublicKeyToken=null")
rebar_hook_orientation_4 = RebarHookOrientation("Right", EnumerationType="Autodesk.Revit.DB.Structure.RebarHookOrientation, RevitAPI, Version=23.0.0.0, Culture=neutral, PublicKeyToken=null")
rebar_hook_type_4 = RevitRebarHookType("None", ElementType="Autodesk.Revit.DB.Structure.RebarHookType, RevitAPI, Version=23.0.0.0, Culture=neutral, PublicKeyToken=null")
YAxis_4 = Vector.YAxis()
reverse_4 = Vector.Reverse(vector=YAxis_4)

byCurve_7 = Rebar.ByCurve(curve=byStartPointEndPoint_4, hostElementId=id_4, rebarStyle=rebar_style_4, rebarBarType=slab_rebar_bar_type, startHookOrientation=rebar_hook_orientation_4, endHookOrientation=rebar_hook_orientation_4, startHookType=rebar_hook_type_4, endHookType=rebar_hook_type_4, vector=reverse_4)
setLayoutAsMaximumSpacing_7 = StructuralDesign.Rebar.Layout.SetLayoutAsMaximumSpacing(rebar=byCurve_7, spacing=slab_rebar_spacing, arrayLength=rebar_dist_length_in_x_plane_2)
first_rebar_2 = CodeBlock(SpL=special_length_rebar, HookLength=hook_length) { SpL-HookLength; }
pointAtSegmentLength_5 = Curve.PointAtSegmentLength(curve=byStartPointDirectionLength_7, segmentLength=first_rebar_2)
splitByPoints_5 = Curve.SplitByPoints(curve=byStartPointDirectionLength_7, points=pointAtSegmentLength_5)
firstItem_5 = List.FirstItem(list=splitByPoints_5@L2)
startPoint_13 = Curve.StartPoint(curve=firstItem_5)
ZAxis_4 = Vector.ZAxis()
byStartPointDirectionLength_15 = Line.ByStartPointDirectionLength(startPoint=startPoint_13, direction=ZAxis_4, length=hook_length)
endPoint_9 = Curve.EndPoint(curve=firstItem_5)
byStartPointEndPoint_5 = Line.ByStartPointEndPoint(startPoint=startPoint_13, endPoint=endPoint_9)
list_create_7 = List.Create(item0=byStartPointDirectionLength_15, item1=byStartPointEndPoint_5)
transpose_7 = List.Transpose(lists=list_create_7)
byJoinedCurves_11 = PolyCurve.ByJoinedCurves(curves=transpose_7)
byCurve_8 = Rebar.ByCurve(curve=byJoinedCurves_11, hostElementId=id_4, rebarStyle=rebar_style_4, rebarBarType=slab_rebar_bar_type, startHookOrientation=rebar_hook_orientation_4, endHookOrientation=rebar_hook_orientation_4, startHookType=rebar_hook_type_4, endHookType=rebar_hook_type_4, vector=reverse_4)
setLayoutAsMaximumSpacing_8 = StructuralDesign.Rebar.Layout.SetLayoutAsMaximumSpacing(rebar=byCurve_8, spacing=slab_rebar_spacing, arrayLength=rebar_dist_length_in_x_plane_2)
code_block_7 = CodeBlock(FirstRebar=first_rebar_2, Spl=special_length_rebar, LapSpliceLength=lap_splice_length) { FirstRebar+Spl-2*LapSpliceLength; }
pointAtSegmentLength_6 = Curve.PointAtSegmentLength(curve=byStartPointDirectionLength_7, segmentLength=code_block_7)
splitByPoints_6 = Curve.SplitByPoints(curve=byStartPointDirectionLength_7, points=pointAtSegmentLength_6)
lastItem_5 = List.LastItem(list=splitByPoints_6@L2)
startPoint_14 = Curve.StartPoint(curve=lastItem_5)
endPoint_10 = Curve.EndPoint(curve=lastItem_5)
byStartPointEndPoint_6 = Line.ByStartPointEndPoint(startPoint=startPoint_14, endPoint=endPoint_10)
byStartPointDirectionLength_16 = Line.ByStartPointDirectionLength(startPoint=endPoint_10, direction=ZAxis_3, length=hook_length)
list_create_8 = List.Create(item0=byStartPointEndPoint_6, item1=byStartPointDirectionLength_16)
transpose_8 = List.Transpose(lists=list_create_8)
byJoinedCurves_12 = PolyCurve.ByJoinedCurves(curves=transpose_8)
byCurve_9 = Rebar.ByCurve(curve=byJoinedCurves_12, hostElementId=id_4, rebarStyle=rebar_style_4, rebarBarType=slab_rebar_bar_type, startHookOrientation=rebar_hook_orientation_4, endHookOrientation=rebar_hook_orientation_4, startHookType=rebar_hook_type_4, endHookType=rebar_hook_type_4, vector=reverse_4)
setLayoutAsMaximumSpacing_9 = StructuralDesign.Rebar.Layout.SetLayoutAsMaximumSpacing(rebar=byCurve_9, spacing=slab_rebar_spacing, arrayLength=rebar_dist_length_in_x_plane_2)
