# Dynamo graph Making Wall Rebar With Lap Splice_26Sept2023.dyn (Dynamo 2.13.1.3887)
# packages: Dynamo for Rebar 2.0.2, Structural Design 2023.4.25

# group: Inputs
select_face_yz_plane = DSFaceSelection()  # 1 picked in the model
select_face_xy_plane = DSFaceSelection()  # 1 picked in the model
concrete_cover = DoubleInput(40)
hook_length = DoubleInput(50)
select_model_element = DSModelElementSelection()  # 1 picked in the model
wall_rebar_bar_type = RebarBarType("10M", ElementType="Autodesk.Revit.DB.Structure.RebarBarType, RevitAPI, Version=23.0.0.0, Culture=neutral, PublicKeyToken=null")
wall_rebar_spacing = DoubleInput(400)

# group: Information of YZ-Plane
perimeterCurves = Surface.PerimeterCurves(surface=select_face_yz_plane)
startPoint = Curve.StartPoint(curve=perimeterCurves)
byCornerPoints = Rectangle.ByCornerPoints(points=startPoint)
width = Rectangle.Width(rectangle=byCornerPoints)
height = Rectangle.Height(rectangle=byCornerPoints)

# group: Create Main Curve of Slab Rebar in XY-Plane to Z-Direction
perimeterCurves_2 = Surface.PerimeterCurves(surface=select_face_xy_plane)
byJoinedCurves = PolyCurve.ByJoinedCurves(curves=perimeterCurves_2)
code_block = CodeBlock(ConcreteCover=concrete_cover) { ConcreteCover*-1; }
offset = Curve.Offset(curve=byJoinedCurves, distance=code_block)
byJoinedCurves_2 = PolyCurve.ByJoinedCurves(curves=offset@L1)
curves = PolyCurve.Curves(polyCurve=byJoinedCurves_2)
startPoint_2 = Curve.StartPoint(curve=curves@L1)
lastItem = List.LastItem(list=startPoint_2@L2)
ZAxis = Vector.ZAxis()
code_block_2 = CodeBlock(YPlaneWidth=height, ConcreteCover=concrete_cover) { YPlaneWidth-ConcreteCover; }
byStartPointDirectionLength = Line.ByStartPointDirectionLength(startPoint=lastItem, direction=ZAxis, length=code_block_2)
firstItem = List.FirstItem(list=startPoint_2@L2)
byStartPointDirectionLength_2 = Line.ByStartPointDirectionLength(startPoint=firstItem, direction=ZAxis, length=code_block_2)  # frozen

# group: Create Curve for Hook Length and Combine It with Main Slab Rebar
startPoint_3 = Curve.StartPoint(curve=byStartPointDirectionLength)  # frozen
YAxis = Vector.YAxis()
reverse = Vector.Reverse(vector=YAxis)
byStartPointDirectionLength_3 = Line.ByStartPointDirectionLength(startPoint=startPoint_3, direction=reverse, length=hook_length)
endPoint = Curve.EndPoint(curve=byStartPointDirectionLength)  # frozen
byStartPointDirectionLength_4 = Line.ByStartPointDirectionLength(startPoint=endPoint, direction=reverse, length=hook_length)
list_create = List.Create(item0=byStartPointDirectionLength_3, item1=byStartPointDirectionLength, item2=byStartPointDirectionLength_4)
transpose = List.Transpose(lists=list_create)
byJoinedCurves_3 = PolyCurve.ByJoinedCurves(curves=transpose)
startPoint_4 = Curve.StartPoint(curve=byStartPointDirectionLength_2)
byStartPointDirectionLength_5 = Line.ByStartPointDirectionLength(startPoint=startPoint_4, direction=YAxis, length=hook_length)
endPoint_2 = Curve.EndPoint(curve=byStartPointDirectionLength_2)
byStartPointDirectionLength_6 = Line.ByStartPointDirectionLength(startPoint=endPoint_2, direction=YAxis, length=hook_length)
list_create_2 = List.Create(item0=byStartPointDirectionLength_5, item1=byStartPointDirectionLength_2, item2=byStartPointDirectionLength_6)
transpose_2 = List.Transpose(lists=list_create_2)
byJoinedCurves_4 = PolyCurve.ByJoinedCurves(curves=transpose_2)

# group: Information to create slab rebar
id = Element.Id(element=select_model_element)
rebar_style = RebarStyle("Standard", EnumerationType="Autodesk.Revit.DB.Structure.RebarStyle, RevitAPI, Version=23.0.0.0, Culture=neutral, PublicKeyToken=null")
rebar_hook_orientation = RebarHookOrientation("Right", EnumerationType="Autodesk.Revit.DB.Structure.RebarHookOrientation, RevitAPI, Version=23.0.0.0, Culture=neutral, PublicKeyToken=null")
rebar_hook_type = RevitRebarHookType("None", ElementType="Autodesk.Revit.DB.Structure.RebarHookType, RevitAPI, Version=23.0.0.0, Culture=neutral, PublicKeyToken=null")
XAxis = Vector.XAxis()
reverse_2 = Vector.Reverse(vector=XAxis)

# group: Information of XY-Plane
perimeterCurves_3 = Surface.PerimeterCurves(surface=select_face_xy_plane)
startPoint_5 = Curve.StartPoint(curve=perimeterCurves_3)
byCornerPoints_2 = Rectangle.ByCornerPoints(points=startPoint_5)
height_2 = Rectangle.Height(rectangle=byCornerPoints_2)
width_2 = Rectangle.Width(rectangle=byCornerPoints_2)

# group: Create and Distribute Rebar in X-Direction
byCurve = Rebar.ByCurve(curve=byJoinedCurves_3, hostElementId=id, rebarStyle=rebar_style, rebarBarType=wall_rebar_bar_type, startHookOrientation=rebar_hook_orientation, endHookOrientation=rebar_hook_orientation, startHookType=rebar_hook_type, endHookType=rebar_hook_type, vector=reverse_2)
rebar_dist_length_in_x_plane = CodeBlock(XPlaneLength=height_2, cover=concrete_cover) { XPlaneLength-2*cover; }
setLayoutAsMaximumSpacing = StructuralDesign.Rebar.Layout.SetLayoutAsMaximumSpacing(rebar=byCurve, spacing=wall_rebar_spacing, arrayLength=rebar_dist_length_in_x_plane)
byCurve_2 = Rebar.ByCurve(curve=byJoinedCurves_4, hostElementId=id, rebarStyle=rebar_style, rebarBarType=wall_rebar_bar_type, startHookOrientation=rebar_hook_orientation, endHookOrientation=rebar_hook_orientation, startHookType=rebar_hook_type, endHookType=rebar_hook_type, vector=reverse_2)
setLayoutAsMaximumSpacing_2 = StructuralDesign.Rebar.Layout.SetLayoutAsMaximumSpacing(rebar=byCurve_2, spacing=wall_rebar_spacing, arrayLength=rebar_dist_length_in_x_plane)

# group: Create Main Curve of Slab Rebar in YZ-Plane to X-Direction
perimeterCurves_4 = Surface.PerimeterCurves(surface=select_face_yz_plane)
byJoinedCurves_5 = PolyCurve.ByJoinedCurves(curves=perimeterCurves_4)
code_block_3 = CodeBlock(ConcreteCover=concrete_cover) { ConcreteCover*-1; }
offset_2 = Curve.Offset(curve=byJoinedCurves_5, distance=code_block_3)
byJoinedCurves_6 = PolyCurve.ByJoinedCurves(curves=offset_2@L1)
curves_2 = PolyCurve.Curves(polyCurve=byJoinedCurves_6)
startPoint_6 = Curve.StartPoint(curve=curves_2@L1)
lastItem_2 = List.LastItem(list=startPoint_6@L2)
XAxis_2 = Vector.XAxis()
code_block_4 = CodeBlock(XPlaneWidth=height_2, ConcreteCover=concrete_cover) { XPlaneWidth-ConcreteCover; }
byStartPointDirectionLength_7 = Line.ByStartPointDirectionLength(startPoint=lastItem_2, direction=XAxis_2, length=code_block_4)
firstItem_2 = List.FirstItem(list=startPoint_6@L2)
byStartPointDirectionLength_8 = Line.ByStartPointDirectionLength(startPoint=firstItem_2, direction=XAxis_2, length=code_block_4)  # frozen

# group: Create Curve for Hook Length and Combine It with Main Slab Rebar
startPoint_7 = Curve.StartPoint(curve=byStartPointDirectionLength_7)  # frozen
YAxis_2 = Vector.YAxis()
reverse_3 = Vector.Reverse(vector=YAxis_2)
byStartPointDirectionLength_9 = Line.ByStartPointDirectionLength(startPoint=startPoint_7, direction=reverse_3, length=hook_length)
endPoint_3 = Curve.EndPoint(curve=byStartPointDirectionLength_7)  # frozen
byStartPointDirectionLength_10 = Line.ByStartPointDirectionLength(startPoint=endPoint_3, direction=reverse_3, length=hook_length)
list_create_3 = List.Create(item0=byStartPointDirectionLength_9, item1=byStartPointDirectionLength_7, item2=byStartPointDirectionLength_10)
transpose_3 = List.Transpose(lists=list_create_3)
byJoinedCurves_7 = PolyCurve.ByJoinedCurves(curves=transpose_3)
startPoint_8 = Curve.StartPoint(curve=byStartPointDirectionLength_8)
byStartPointDirectionLength_11 = Line.ByStartPointDirectionLength(startPoint=startPoint_8, direction=YAxis_2, length=hook_length)
endPoint_4 = Curve.EndPoint(curve=byStartPointDirectionLength_8)
byStartPointDirectionLength_12 = Line.ByStartPointDirectionLength(startPoint=endPoint_4, direction=YAxis_2, length=hook_length)
list_create_4 = List.Create(item0=byStartPointDirectionLength_11, item1=byStartPointDirectionLength_8, item2=byStartPointDirectionLength_12)
transpose_4 = List.Transpose(lists=list_create_4)
byJoinedCurves_8 = PolyCurve.ByJoinedCurves(curves=transpose_4)

# group: Information to create slab rebar
id_2 = Element.Id(element=select_model_element)
rebar_style_2 = RebarStyle("Standard", EnumerationType="Autodesk.Revit.DB.Structure.RebarStyle, RevitAPI, Version=23.0.0.0, Culture=neutral, PublicKeyToken=null")
rebar_hook_orientation_2 = RebarHookOrientation("Right", EnumerationType="Autodesk.Revit.DB.Structure.RebarHookOrientation, RevitAPI, Version=23.0.0.0, Culture=neutral, PublicKeyToken=null")
rebar_hook_type_2 = RevitRebarHookType("None", ElementType="Autodesk.Revit.DB.Structure.RebarHookType, RevitAPI, Version=23.0.0.0, Culture=neutral, PublicKeyToken=null")
ZAxis_2 = Vector.ZAxis()

# group: Create and Distribute Rebar in Z-Direction
byCurve_3 = Rebar.ByCurve(curve=byJoinedCurves_7, hostElementId=id_2, rebarStyle=rebar_style_2, rebarBarType=wall_rebar_bar_type, startHookOrientation=rebar_hook_orientation_2, endHookOrientation=rebar_hook_orientation_2, startHookType=rebar_hook_type_2, endHookType=rebar_hook_type_2, vector=ZAxis_2)
rebar_dist_length_in_x_plane_2 = CodeBlock(YPlaneLength=height, cover=concrete_cover) { YPlaneLength-2*cover; }
setLayoutAsMaximumSpacing_3 = StructuralDesign.Rebar.Layout.SetLayoutAsMaximumSpacing(rebar=byCurve_3, spacing=wall_rebar_spacing, arrayLength=rebar_dist_length_in_x_plane_2)
byCurve_4 = Rebar.ByCurve(curve=byJoinedCurves_8, hostElementId=id_2, rebarStyle=rebar_style_2, rebarBarType=wall_rebar_bar_type, startHookOrientation=rebar_hook_orientation_2, endHookOrientation=rebar_hook_orientation_2, startHookType=rebar_hook_type_2, endHookType=rebar_hook_type_2, vector=ZAxis_2)
setLayoutAsMaximumSpacing_4 = StructuralDesign.Rebar.Layout.SetLayoutAsMaximumSpacing(rebar=byCurve_4, spacing=wall_rebar_spacing, arrayLength=rebar_dist_length_in_x_plane_2)

special_length_rebar = DoubleInput(8000)

# group: Script for special length and lap splice implementation of wall rebar
code_block_5 = CodeBlock(SpL=special_length_rebar, HookLength=hook_length) { SpL-HookLength; }
pointAtSegmentLength = Curve.PointAtSegmentLength(curve=byStartPointDirectionLength, segmentLength=code_block_5)
splitByPoints = Curve.SplitByPoints(curve=byStartPointDirectionLength, points=pointAtSegmentLength)
firstItem_3 = List.FirstItem(list=splitByPoints@L2)
startPoint_9 = Curve.StartPoint(curve=firstItem_3)
YAxis_3 = Vector.YAxis()
reverse_4 = Vector.Reverse(vector=YAxis_3)
byStartPointDirectionLength_13 = Line.ByStartPointDirectionLength(startPoint=startPoint_9, direction=reverse_4, length=hook_length)
endPoint_5 = Curve.EndPoint(curve=firstItem_3)
byStartPointEndPoint = Line.ByStartPointEndPoint(startPoint=startPoint_9, endPoint=endPoint_5)
list_create_5 = List.Create(item0=byStartPointDirectionLength_13, item1=byStartPointEndPoint)
transpose_5 = List.Transpose(lists=list_create_5)
byJoinedCurves_9 = PolyCurve.ByJoinedCurves(curves=transpose_5)

lap_splice_length = DoubleInput(1300)

# group: Script for special length and lap splice implementation of wall rebar
XAxis_3 = Vector.XAxis()
rebar_movement = DoubleInput(20)
translate = Geometry.Translate(geometry=byStartPointDirectionLength, direction=XAxis_3, distance=rebar_movement)
code_block_6 = CodeBlock(FirstRebar=code_block_5, LapSpliceLength=lap_splice_length) { FirstRebar-LapSpliceLength; }
pointAtSegmentLength_2 = Curve.PointAtSegmentLength(curve=translate, segmentLength=code_block_6)
splitByPoints_2 = Curve.SplitByPoints(curve=translate, points=pointAtSegmentLength_2)
lastItem_3 = List.LastItem(list=splitByPoints_2@L2)
startPoint_10 = Curve.StartPoint(curve=lastItem_3)
endPoint_6 = Curve.EndPoint(curve=lastItem_3)
byStartPointEndPoint_2 = Line.ByStartPointEndPoint(startPoint=startPoint_10, endPoint=endPoint_6)
YAxis_4 = Vector.YAxis()
reverse_5 = Vector.Reverse(vector=YAxis_4)
byStartPointDirectionLength_14 = Line.ByStartPointDirectionLength(startPoint=endPoint_6, direction=reverse_5, length=hook_length)
list_create_6 = List.Create(item0=byStartPointEndPoint_2, item1=byStartPointDirectionLength_14)
transpose_6 = List.Transpose(lists=list_create_6)
byJoinedCurves_10 = PolyCurve.ByJoinedCurves(curves=transpose_6)

# group: Information to create slab rebar
id_3 = Element.Id(element=select_model_element)
rebar_style_3 = RebarStyle("Standard", EnumerationType="Autodesk.Revit.DB.Structure.RebarStyle, RevitAPI, Version=23.0.0.0, Culture=neutral, PublicKeyToken=null")
rebar_hook_orientation_3 = RebarHookOrientation("Right", EnumerationType="Autodesk.Revit.DB.Structure.RebarHookOrientation, RevitAPI, Version=23.0.0.0, Culture=neutral, PublicKeyToken=null")
rebar_hook_type_3 = RevitRebarHookType("None", ElementType="Autodesk.Revit.DB.Structure.RebarHookType, RevitAPI, Version=23.0.0.0, Culture=neutral, PublicKeyToken=null")
XAxis_4 = Vector.XAxis()
reverse_6 = Vector.Reverse(vector=XAxis_4)
ZAxis_3 = Vector.ZAxis()

# group: Create and Distribute Rebar in X-Direction
byCurve_5 = Rebar.ByCurve(curve=byJoinedCurves_10, hostElementId=id_3, rebarStyle=rebar_style_3, rebarBarType=wall_rebar_bar_type, startHookOrientation=rebar_hook_orientation_3, endHookOrientation=rebar_hook_orientation_3, startHookType=rebar_hook_type_3, endHookType=rebar_hook_type_3, vector=reverse_6)
rebar_dist_length_in_x_plane_3 = CodeBlock(XPlaneLength=height_2, cover=concrete_cover) { XPlaneLength-2*cover; }
setLayoutAsMaximumSpacing_5 = StructuralDesign.Rebar.Layout.SetLayoutAsMaximumSpacing(rebar=byCurve_5, spacing=wall_rebar_spacing, arrayLength=rebar_dist_length_in_x_plane_3)
byCurve_6 = Rebar.ByCurve(curve=byJoinedCurves_9, hostElementId=id_3, rebarStyle=rebar_style_3, rebarBarType=wall_rebar_bar_type, startHookOrientation=rebar_hook_orientation_3, endHookOrientation=rebar_hook_orientation_3, startHookType=rebar_hook_type_3, endHookType=rebar_hook_type_3, vector=reverse_6)
setLayoutAsMaximumSpacing_6 = StructuralDesign.Rebar.Layout.SetLayoutAsMaximumSpacing(rebar=byCurve_6, spacing=wall_rebar_spacing, arrayLength=rebar_dist_length_in_x_plane_3)

# group: Script for special length and lap splice implementation of wall rebar
code_block_7 = CodeBlock(SpL=special_length_rebar, HookLength=hook_length) { SpL-HookLength; }
pointAtSegmentLength_3 = Curve.PointAtSegmentLength(curve=byStartPointDirectionLength_7, segmentLength=code_block_7)
splitByPoints_3 = Curve.SplitByPoints(curve=byStartPointDirectionLength_7, points=pointAtSegmentLength_3)
firstItem_4 = List.FirstItem(list=splitByPoints_3@L2)
startPoint_11 = Curve.StartPoint(curve=firstItem_4)
YAxis_5 = Vector.YAxis()
reverse_7 = Vector.Reverse(vector=YAxis_5)
byStartPointDirectionLength_15 = Line.ByStartPointDirectionLength(startPoint=startPoint_11, direction=reverse_7, length=hook_length)
endPoint_7 = Curve.EndPoint(curve=firstItem_4)
byStartPointEndPoint_3 = Line.ByStartPointEndPoint(startPoint=startPoint_11, endPoint=endPoint_7)
list_create_7 = List.Create(item0=byStartPointDirectionLength_15, item1=byStartPointEndPoint_3)
transpose_7 = List.Transpose(lists=list_create_7)
byJoinedCurves_11 = PolyCurve.ByJoinedCurves(curves=transpose_7)

# group: Script for special length and lap splice implementation of wall rebar
ZAxis_4 = Vector.ZAxis()
rebar_movement_2 = DoubleInput(20)
translate_2 = Geometry.Translate(geometry=byStartPointDirectionLength_7, direction=ZAxis_4, distance=rebar_movement_2)
code_block_8 = CodeBlock(FirstRebar=code_block_7, LapSpliceLength=lap_splice_length) { FirstRebar-LapSpliceLength; }
pointAtSegmentLength_4 = Curve.PointAtSegmentLength(curve=translate_2, segmentLength=code_block_8)
splitByPoints_4 = Curve.SplitByPoints(curve=translate_2, points=pointAtSegmentLength_4)
lastItem_4 = List.LastItem(list=splitByPoints_4@L2)
startPoint_12 = Curve.StartPoint(curve=lastItem_4)
endPoint_8 = Curve.EndPoint(curve=lastItem_4)
byStartPointEndPoint_4 = Line.ByStartPointEndPoint(startPoint=startPoint_12, endPoint=endPoint_8)
YAxis_6 = Vector.YAxis()
reverse_8 = Vector.Reverse(vector=YAxis_6)
byStartPointDirectionLength_16 = Line.ByStartPointDirectionLength(startPoint=endPoint_8, direction=reverse_8, length=hook_length)
list_create_8 = List.Create(item0=byStartPointEndPoint_4, item1=byStartPointDirectionLength_16)
transpose_8 = List.Transpose(lists=list_create_8)
byJoinedCurves_12 = PolyCurve.ByJoinedCurves(curves=transpose_8)

# group: Create and Distribute Rebar in X-Direction
byCurve_7 = Rebar.ByCurve(curve=byJoinedCurves_12, hostElementId=id_3, rebarStyle=rebar_style_3, rebarBarType=wall_rebar_bar_type, startHookOrientation=rebar_hook_orientation_3, endHookOrientation=rebar_hook_orientation_3, startHookType=rebar_hook_type_3, endHookType=rebar_hook_type_3, vector=ZAxis_3)
rebar_dist_length_in_x_plane_4 = CodeBlock(YPlaneLength=height, cover=concrete_cover) { YPlaneLength-2*cover; }
setLayoutAsMaximumSpacing_7 = StructuralDesign.Rebar.Layout.SetLayoutAsMaximumSpacing(rebar=byCurve_7, spacing=wall_rebar_spacing, arrayLength=rebar_dist_length_in_x_plane_4)
byCurve_8 = Rebar.ByCurve(curve=byJoinedCurves_11, hostElementId=id_3, rebarStyle=rebar_style_3, rebarBarType=wall_rebar_bar_type, startHookOrientation=rebar_hook_orientation_3, endHookOrientation=rebar_hook_orientation_3, startHookType=rebar_hook_type_3, endHookType=rebar_hook_type_3, vector=ZAxis_3)
setLayoutAsMaximumSpacing_8 = StructuralDesign.Rebar.Layout.SetLayoutAsMaximumSpacing(rebar=byCurve_8, spacing=wall_rebar_spacing, arrayLength=rebar_dist_length_in_x_plane_4)
