# Dynamo graph ExportIFC_26Oct2023.dyn (Dynamo 2.13.1.3887)

string = StringInput("@")
shape_type = StringInput("BF2D")
header_block = StringInput("Hj")
geometry_block = StringInput("G")
join = String.Join(separator=string, string0=shape_type, string1=header_block, string2=geometry_block)
concat = String.Concat()  # unwired: string0
select_model_elements_by = DSModelElementsByCategorySelection("OST_Rebar")  # "Select Model Elements By Category"; 1 picked in the model
code_block = CodeBlock { "A"; }
string_from_object = FromObject()  # unwired: object
