# Dynamo graph Making Beam Rebar at MiddleSpan3_25Oct2023.dyn (Dynamo 2.13.1.3887)
# packages: Dynamo for Rebar 2.0.2, Structural Design 2023.4.25, BIM4Struc.Rebar 1.3.0

# group: Inputs
select_face_yz_plane_of_beam = DSFaceSelection()  # 1 picked in the model
concrete_cover = DoubleInput(40)
stirrup_rebar_bar_type = RebarBarType("10M", ElementType="Autodesk.Revit.DB.Structure.RebarBarType, RevitAPI, Version=23.0.0.0, Culture=neutral, PublicKeyToken=null")
long_rebar_bar_type = RebarBarType(ElementType="Autodesk.Revit.DB.Structure.RebarBarType, RevitAPI, Version=23.0.0.0, Culture=neutral, PublicKeyToken=null")  # nothing selected
distance_from_yz_plane_to_start = CodeBlock { 486; }  # "Distance from YZ-plane to start point of SpL rebar"
select_model_element_of_beam = DSModelElementSelection()  # 1 picked in the model
special_length_rebar = CodeBlock { 10700; }
bars_along_b_of_top_rebar = DoubleInput(3)
bars_along_b_of_bottom_rebar = DoubleInput(3)
stirrup_spacing_at_end_of_beam = DoubleInput(200)
select_model_element_of_column = DSModelElementSelection()  # 1 picked in the model
stirrup_spacing_at_middle_of = DoubleInput(400)  # "Stirrup spacing at middle of beam"

# group: Create Main Curve of Longitudinal Rebar
perimeterCurves = Surface.PerimeterCurves(surface=select_face_yz_plane_of_beam)
byJoinedCurves = PolyCurve.ByJoinedCurves(curves=perimeterCurves)
rebarDiameter = StructuralDesign.Rebar.Properties.RebarDiameter(rebar=stirrup_rebar_bar_type)
rebarDiameter_2 = StructuralDesign.Rebar.Properties.RebarDiameter(rebar=long_rebar_bar_type)
code_block = CodeBlock(ConcreteCover=concrete_cover, StirrupDia=rebarDiameter, LongDia=rebarDiameter_2) { (ConcreteCover+StirrupDia+0.5*LongDia)*-1; }
offset = Curve.Offset(curve=byJoinedCurves, distance=code_block)
byJoinedCurves_2 = PolyCurve.ByJoinedCurves(curves=offset@L1)
curves = PolyCurve.Curves(polyCurve=byJoinedCurves_2)
startPoint = Curve.StartPoint(curve=curves@L1)
lastItem = List.LastItem(list=startPoint@L2)
XAxis = Vector.XAxis()
byStartPointDirectionLength = Line.ByStartPointDirectionLength(startPoint=lastItem, direction=XAxis, length=distance_from_yz_plane_to_start)
firstItem = List.FirstItem(list=startPoint@L2)
byStartPointDirectionLength_2 = Line.ByStartPointDirectionLength(startPoint=firstItem, direction=XAxis, length=distance_from_yz_plane_to_start)

# group: Create Curve for Anchorage Hook Length and Combine It with Longitudinal Rebar
startPoint_2 = Curve.StartPoint(curve=byStartPointDirectionLength)
endPoint = Curve.EndPoint(curve=byStartPointDirectionLength_2)
XAxis_2 = Vector.XAxis()
byStartPointDirectionLength_3 = Line.ByStartPointDirectionLength(startPoint=endPoint, direction=XAxis_2, length=special_length_rebar)
endPoint_2 = Curve.EndPoint(curve=byStartPointDirectionLength)
byStartPointDirectionLength_4 = Line.ByStartPointDirectionLength(startPoint=endPoint_2, direction=XAxis_2, length=special_length_rebar)

# group: Beam and Column Information
concreteBeamColumnCharacteristics = StructuralDesign.Model.Opening.Geometry.ConcreteBeamColumnCharacteristics(element=select_model_element_of_beam)
concreteBeamColumnCharacteristics_2 = StructuralDesign.Model.Opening.Geometry.ConcreteBeamColumnCharacteristics(element=select_model_element_of_column)

# group: Information to create long. rebar
id = Element.Id(element=select_model_element_of_beam)
rebar_style = RebarStyle("Standard", EnumerationType="Autodesk.Revit.DB.Structure.RebarStyle, RevitAPI, Version=23.0.0.0, Culture=neutral, PublicKeyToken=null")
rebar_hook_orientation = RebarHookOrientation("Right", EnumerationType="Autodesk.Revit.DB.Structure.RebarHookOrientation, RevitAPI, Version=23.0.0.0, Culture=neutral, PublicKeyToken=null")
rebar_hook_type = RevitRebarHookType("None", ElementType="Autodesk.Revit.DB.Structure.RebarHookType, RevitAPI, Version=23.0.0.0, Culture=neutral, PublicKeyToken=null")
YAxis = Vector.YAxis()

# group: Create and Distribute Top and Bottom Rebar
byCurve = Rebar.ByCurve(curve=byStartPointDirectionLength_3, hostElementId=id, rebarStyle=rebar_style, rebarBarType=long_rebar_bar_type, startHookOrientation=rebar_hook_orientation, endHookOrientation=rebar_hook_orientation, startHookType=rebar_hook_type, endHookType=rebar_hook_type, vector=YAxis)
code_block_2 = CodeBlock(BeamWidth=concreteBeamColumnCharacteristics.Width, cover=concrete_cover, StirrupDia=rebarDiameter, LongDia=rebarDiameter_2) { BeamWidth-2*cover-2*StirrupDia-LongDia; }
setLayoutAsFixedNumber = StructuralDesign.Rebar.Layout.SetLayoutAsFixedNumber(rebar=byCurve, arrayLength=code_block_2, numberOfBarPositions=bars_along_b_of_top_rebar)
byCurve_2 = Rebar.ByCurve(curve=byStartPointDirectionLength_4, hostElementId=id, rebarStyle=rebar_style, rebarBarType=long_rebar_bar_type, startHookOrientation=rebar_hook_orientation, endHookOrientation=rebar_hook_orientation, startHookType=rebar_hook_type, endHookType=rebar_hook_type, vector=YAxis)
setLayoutAsFixedNumber_2 = StructuralDesign.Rebar.Layout.SetLayoutAsFixedNumber(rebar=byCurve_2, arrayLength=code_block_2, numberOfBarPositions=bars_along_b_of_bottom_rebar)

# group: Set Rebar Shape and Solid In View
rebarShape = RevitRebarShape("BS Shape Code 00")
setRebarShapeId = StructuralDesign.Rebar.Create.SetRebarShapeId(rebar=setLayoutAsFixedNumber, rebarShape=rebarShape.out1)
views = Views("{3D}")
setSolidInView = Custom[Rebar.SetSolidInView](rebarElements=setRebarShapeId, views=views)  # package BIM4Struc.Rebar; Sets this rebar element to be shown solidly in a 3D view.
setRebarShapeId_2 = StructuralDesign.Rebar.Create.SetRebarShapeId(rebar=setLayoutAsFixedNumber_2, rebarShape=rebarShape.out1)
setSolidInView_2 = Custom[Rebar.SetSolidInView](rebarElements=setRebarShapeId_2, views=views)

# group: Create Stirrup Curve
perimeterCurves_2 = Surface.PerimeterCurves(surface=select_face_yz_plane_of_beam)
byJoinedCurves_3 = PolyCurve.ByJoinedCurves(curves=perimeterCurves_2)
code_block_3 = CodeBlock(ConcreteCover=concrete_cover) { ConcreteCover*-1; }
offset_2 = Curve.Offset(curve=byJoinedCurves_3, distance=code_block_3)
byJoinedCurves_4 = PolyCurve.ByJoinedCurves(curves=offset_2)

# group: Information to Create Stirrup
id_2 = Element.Id(element=select_model_element_of_beam)
rebar_style_2 = RebarStyle("StirrupTie", EnumerationType="Autodesk.Revit.DB.Structure.RebarStyle, RevitAPI, Version=23.0.0.0, Culture=neutral, PublicKeyToken=null")
rebar_hook_orientation_2 = RebarHookOrientation("Right", EnumerationType="Autodesk.Revit.DB.Structure.RebarHookOrientation, RevitAPI, Version=23.0.0.0, Culture=neutral, PublicKeyToken=null")
rebar_hook_type_2 = RevitRebarHookType("Stirrup/Tie - 135 deg.", ElementType="Autodesk.Revit.DB.Structure.RebarHookType, RevitAPI, Version=23.0.0.0, Culture=neutral, PublicKeyToken=null")
XAxis_3 = Vector.XAxis()

# group: Calculate Distribution Length of Stirrup
length_of_stirrup_dist_at_the = CodeBlock(BeamLength=concreteBeamColumnCharacteristics.Length, cover=concrete_cover, ColumnWidth=concreteBeamColumnCharacteristics_2.Width) { (BeamLength-2*cover-ColumnWidth)*0.25; }  # "Length of stirrup dist. at the end of beam"
code_block_4 = CodeBlock(BeamLength=concreteBeamColumnCharacteristics.Length, STLength1=length_of_stirrup_dist_at_the, cover=concrete_cover, ColumnWidth=concreteBeamColumnCharacteristics_2.Width) { BeamLength-2*STLength1-2*cover-ColumnWidth; }

# group: Create and Distribute Stirrup Rebar
code_block_5 = CodeBlock(BeamWidth=concreteBeamColumnCharacteristics.Width, StirrupDia=rebarDiameter, LongDia=rebarDiameter_2) { BeamWidth-2*StirrupDia-LongDia; }
byCurve_3 = Rebar.ByCurve(curve=byJoinedCurves_4, hostElementId=id_2, rebarStyle=rebar_style_2, rebarBarType=stirrup_rebar_bar_type, startHookOrientation=rebar_hook_orientation_2, endHookOrientation=rebar_hook_orientation_2, startHookType=rebar_hook_type_2, endHookType=rebar_hook_type_2, vector=XAxis_3)
setLayoutAsMaximumSpacing = StructuralDesign.Rebar.Layout.SetLayoutAsMaximumSpacing(rebar=byCurve_3, spacing=stirrup_spacing_at_end_of_beam, arrayLength=length_of_stirrup_dist_at_the)
translate = Geometry.Translate(geometry=byJoinedCurves_4, xTranslation=length_of_stirrup_dist_at_the)
byCurve_4 = Rebar.ByCurve(curve=translate, hostElementId=id_2, rebarStyle=rebar_style_2, rebarBarType=stirrup_rebar_bar_type, startHookOrientation=rebar_hook_orientation_2, endHookOrientation=rebar_hook_orientation_2, startHookType=rebar_hook_type_2, endHookType=rebar_hook_type_2, vector=XAxis_3)
boolean = BoolSelector(false)
setLayoutAsMaximumSpacing_2 = StructuralDesign.Rebar.Layout.SetLayoutAsMaximumSpacing(rebar=byCurve_4, spacing=stirrup_spacing_at_middle_of, arrayLength=code_block_4, includeFirstBar=boolean, includeLastBar=boolean)
translate_2 = Geometry.Translate(geometry=translate, xTranslation=code_block_4)
byCurve_5 = Rebar.ByCurve(curve=translate_2, hostElementId=id_2, rebarStyle=rebar_style_2, rebarBarType=stirrup_rebar_bar_type, startHookOrientation=rebar_hook_orientation_2, endHookOrientation=rebar_hook_orientation_2, startHookType=rebar_hook_type_2, endHookType=rebar_hook_type_2, vector=XAxis_3)
setLayoutAsMaximumSpacing_3 = StructuralDesign.Rebar.Layout.SetLayoutAsMaximumSpacing(rebar=byCurve_5, spacing=stirrup_spacing_at_end_of_beam, arrayLength=length_of_stirrup_dist_at_the)

# group: Set Rebar Shape and Solid In View
rebarShape_2 = RevitRebarShape("BS Shape Code 52")
setRebarShapeId_3 = StructuralDesign.Rebar.Create.SetRebarShapeId(rebar=setLayoutAsMaximumSpacing, rebarShape=rebarShape_2.out1)
views_2 = Views("{3D}")
setSolidInView_3 = Custom[Rebar.SetSolidInView](rebarElements=setRebarShapeId_3, views=views_2)
setRebarShapeId_4 = StructuralDesign.Rebar.Create.SetRebarShapeId(rebar=setLayoutAsMaximumSpacing_2, rebarShape=rebarShape_2.out1)
setSolidInView_4 = Custom[Rebar.SetSolidInView](rebarElements=setRebarShapeId_4, views=views_2)
setRebarShapeId_5 = StructuralDesign.Rebar.Create.SetRebarShapeId(rebar=setLayoutAsMaximumSpacing_3, rebarShape=rebarShape_2.out1)
setSolidInView_5 = Custom[Rebar.SetSolidInView](rebarElements=setRebarShapeId_5, views=views_2)
