# Dynamo graph Making Column Dowel Bar_31Oct2023.dyn (Dynamo 2.13.1.3887)
# packages: Clockwork for Dynamo 2.x 2.6.0, archi-lab.net 2023.213.1722, BIM4Struc.Productivity 2.2.2, Dynamo for Rebar 2.0.2, BIM4Struc.Rebar 1.3.0, Structural Design 2023.4.25, LunchBox for Dynamo 2017.10.2

# group: Inputs
select_model_element_by_category = DSModelElementByCategorySelection("OST_StructuralColumns")  # 1 picked in the model
concrete_cover = DoubleInput(50)
additional_cover = CodeBlock { 100; }
stirrup_rebar_bar_type = RebarBarType("10M", ElementType="Autodesk.Revit.DB.Structure.RebarBarType, RevitAPI, Version=23.0.0.0, Culture=neutral, PublicKeyToken=null")
longitudinal_rebar_bar_type = RebarBarType("29M", ElementType="Autodesk.Revit.DB.Structure.RebarBarType, RevitAPI, Version=23.0.0.0, Culture=neutral, PublicKeyToken=null")
select_model_element_by_category_2 = DSModelElementByCategorySelection("OST_StructuralFoundation")  # 1 picked in the model
special_length_rebar = DoubleInput(10400)
l_shape_leg_length = DoubleInput(350)
bars_along_b_direction = CodeBlock { 13; }
bars_along_h_direction = CodeBlock { 10; }

# group: Obtain bottom surface of column
faces = Element.Faces(element=select_model_element_by_category)
code_block = CodeBlock { 1; }
flatten = List.Flatten(list=faces, amount=code_block)
filterByOrientation = Custom[Surface.FilterByOrientation](surfaces=flatten)  # package Clockwork for Dynamo 2.x; Sorts surfaces in three lists based on their orientation (vertical, horizontal up & horizontal down) and also returns three corresponding lists of booleans.

# group: Obtain rectangle surface in bottom surface of column. The points of the rectangle will be the points for longitudinal rebar reference
perimeterCurves = Surface.PerimeterCurves(surface=filterByOrientation.horizontalDown)
firstItem = List.FirstItem(list=perimeterCurves@L2)
code_block_2 = CodeBlock(cover=concrete_cover, AdditionalCover=additional_cover) { (cover+AdditionalCover); }
offset = Curve.Offset(curve=firstItem, distance=code_block_2)
code_block_3 = CodeBlock { 1; }
getItemAtIndex = List.GetItemAtIndex(list=perimeterCurves@L2, index=code_block_3)
code_block_4 = CodeBlock(cover=concrete_cover) { cover; }
offset_2 = Curve.Offset(curve=getItemAtIndex, distance=code_block_4)
findIntersections = Geometry.Intersection.FindIntersections(geo=offset, others=offset_2)
code_block_5 = CodeBlock { 2; }
getItemAtIndex_2 = List.GetItemAtIndex(list=perimeterCurves@L2, index=code_block_5)
offset_3 = Curve.Offset(curve=getItemAtIndex_2, distance=code_block_2)
findIntersections_2 = Geometry.Intersection.FindIntersections(geo=offset_2, others=offset_3)
lastItem = List.LastItem(list=perimeterCurves@L2)
offset_4 = Curve.Offset(curve=lastItem, distance=code_block_4)
findIntersections_3 = Geometry.Intersection.FindIntersections(geo=offset_3, others=offset_4)
findIntersections_4 = Geometry.Intersection.FindIntersections(geo=offset_4, others=offset)
byCornerPoints = Rectangle.ByCornerPoints(p1=findIntersections, p2=findIntersections_2, p3=findIntersections_3, p4=findIntersections_4)
byJoinedCurves = PolyCurve.ByJoinedCurves(curves=byCornerPoints)

getBarDiameter = Custom[RebarType.GetBarDiameter](rebarBarType=stirrup_rebar_bar_type)  # package BIM4Struc.Rebar; Get the diameter of a given Rebar Bar Type
getBarDiameter_2 = Custom[RebarType.GetBarDiameter](rebarBarType=longitudinal_rebar_bar_type)
code_block_6 = CodeBlock(StirrupDia=getBarDiameter, LongDia=getBarDiameter_2) { -1*(StirrupDia+LongDia*0.5); }
offset_5 = Curve.Offset(curve=byJoinedCurves, distance=code_block_6)
byJoinedCurves_2 = PolyCurve.ByJoinedCurves(curves=offset_5@L1)
curves = PolyCurve.Curves(polyCurve=byJoinedCurves_2)
startPoint = Curve.StartPoint(curve=curves@L1)
code_block_7 = CodeBlock { 2; }
getItemAtIndex_3 = List.GetItemAtIndex(list=startPoint@L2, index=code_block_7)
ZAxis = Vector.ZAxis()
reverse = Vector.Reverse(vector=ZAxis)
type = archilab.Revit.Elements.Elements.Type(element=select_model_element_by_category_2)
code_block_8 = CodeBlock { "Foundation Thickness"; }
getParameterValueByName = Element.GetParameterValueByName(element=type, parameterName=code_block_8)
footing_cover = CodeBlock { 50; }
locating_the_start_point_of = CodeBlock(FoundationThickness=getParameterValueByName, FootingCover=footing_cover) { FoundationThickness-FootingCover-40; }  # "Locating the start point of straight long rebar in the foundation"
byStartPointDirectionLength = Line.ByStartPointDirectionLength(startPoint=getItemAtIndex_3, direction=reverse, length=locating_the_start_point_of)
endPoint = Curve.EndPoint(curve=byStartPointDirectionLength)
anchorage_length_to_foundation = CodeBlock(SpecialLength=special_length_rebar, HookLength=l_shape_leg_length) { SpecialLength-HookLength; }  # "Anchorage Length to Foundation + Lap Splice"
byStartPointDirectionLength_2 = Line.ByStartPointDirectionLength(startPoint=endPoint, direction=ZAxis, length=anchorage_length_to_foundation)

# group: Vector Management
localCoordinateSystem = Custom[Element.LocalCoordinateSystem](element=select_model_element_by_category_2)  # package BIM4Struc.Productivity; Get the insertion point and local axes of an element.
reverse_2 = Vector.Reverse(vector=localCoordinateSystem.Xvector)
reverse_3 = Vector.Reverse(vector=localCoordinateSystem.Yvector)

# group: Information to create longitudinal rebar
id = Element.Id(element=select_model_element_by_category_2)
rebar_style = RebarStyle("Standard", EnumerationType="Autodesk.Revit.DB.Structure.RebarStyle, RevitAPI, Version=23.0.0.0, Culture=neutral, PublicKeyToken=null")
rebar_hook_orientation = RebarHookOrientation("Right", EnumerationType="Autodesk.Revit.DB.Structure.RebarHookOrientation, RevitAPI, Version=23.0.0.0, Culture=neutral, PublicKeyToken=null")
rebar_hook_type = RevitRebarHookType("None", ElementType="Autodesk.Revit.DB.Structure.RebarHookType, RevitAPI, Version=23.0.0.0, Culture=neutral, PublicKeyToken=null")

# group: Calculate distribution length of longitudinal rebar
type_2 = archilab.Revit.Elements.Elements.Type(element=select_model_element_by_category)
code_block_9 = CodeBlock { "b"; "h"; }
getParameterValueByName_2 = Element.GetParameterValueByName(element=type_2, parameterName=code_block_9.out0)
distribution_length_of_long = CodeBlock(width=getParameterValueByName_2, AdditionalCover=additional_cover, ColumnCover=concrete_cover, StirrupDia=getBarDiameter, LongDia=getBarDiameter_2) { width-2*AdditionalCover-2*ColumnCover-2*StirrupDia-LongDia; }  # "Distribution Length of Long. Rebar in X Direction"
getParameterValueByName_3 = Element.GetParameterValueByName(element=type_2, parameterName=code_block_9.out1)
distribution_length_of_long_2 = CodeBlock(depth=getParameterValueByName_3, ColumnCover=concrete_cover, StirrupDia=getBarDiameter, LongDia=getBarDiameter_2) { depth-2*ColumnCover-2*StirrupDia-LongDia; }  # "Distribution Length of Long. Rebar in Y Direction"

rebarShape = RevitRebarShape("BS8666 12")
views = Views("{3D}")
firstItem_2 = List.FirstItem(list=startPoint@L2)
byStartPointDirectionLength_3 = Line.ByStartPointDirectionLength(startPoint=firstItem_2, direction=reverse, length=locating_the_start_point_of)
endPoint_2 = Curve.EndPoint(curve=byStartPointDirectionLength_3)

# group: Create dowel bar with leg length
startPoint_2 = Curve.StartPoint(curve=byStartPointDirectionLength_2)
# note: Last item which will be distributed in X direction
byStartPointDirectionLength_4 = Line.ByStartPointDirectionLength(startPoint=startPoint_2, direction=localCoordinateSystem.Yvector, length=l_shape_leg_length)
list_create = List.Create(item0=byStartPointDirectionLength_2, item1=byStartPointDirectionLength_4)
transpose = List.Transpose(lists=list_create)
byJoinedCurves_3 = PolyCurve.ByJoinedCurves(curves=transpose)
byStartPointDirectionLength_5 = Line.ByStartPointDirectionLength(startPoint=endPoint_2, direction=ZAxis, length=anchorage_length_to_foundation)
startPoint_3 = Curve.StartPoint(curve=byStartPointDirectionLength_5)
# note: First item which will be distributed in Y direction
byStartPointDirectionLength_6 = Line.ByStartPointDirectionLength(startPoint=startPoint_3, direction=localCoordinateSystem.Xvector, length=l_shape_leg_length)
list_create_2 = List.Create(item0=byStartPointDirectionLength_5, item1=byStartPointDirectionLength_6)
transpose_2 = List.Transpose(lists=list_create_2)
byJoinedCurves_4 = PolyCurve.ByJoinedCurves(curves=transpose_2)
# note: Last item which will be distributed in Y direction
byStartPointDirectionLength_7 = Line.ByStartPointDirectionLength(startPoint=startPoint_2, direction=reverse_2, length=l_shape_leg_length)
list_create_3 = List.Create(item0=byStartPointDirectionLength_2, item1=byStartPointDirectionLength_7)
transpose_3 = List.Transpose(lists=list_create_3)
byJoinedCurves_5 = PolyCurve.ByJoinedCurves(curves=transpose_3)
# note: First item which will be distributed in X direction
byStartPointDirectionLength_8 = Line.ByStartPointDirectionLength(startPoint=startPoint_3, direction=reverse_3, length=l_shape_leg_length)
list_create_4 = List.Create(item0=byStartPointDirectionLength_5, item1=byStartPointDirectionLength_8)
transpose_4 = List.Transpose(lists=list_create_4)
byJoinedCurves_6 = PolyCurve.ByJoinedCurves(curves=transpose_4)

# group: Create Longitudinal Rebar in X Direction
byCurve = Rebar.ByCurve(curve=byJoinedCurves_3, hostElementId=id, rebarStyle=rebar_style, rebarBarType=longitudinal_rebar_bar_type, startHookOrientation=rebar_hook_orientation, endHookOrientation=rebar_hook_orientation, startHookType=rebar_hook_type, endHookType=rebar_hook_type, vector=localCoordinateSystem.Xvector)
setLayoutAsFixedNumber = StructuralDesign.Rebar.Layout.SetLayoutAsFixedNumber(rebar=byCurve, arrayLength=distribution_length_of_long, numberOfBarPositions=bars_along_b_direction)
byCurve_2 = Rebar.ByCurve(curve=byJoinedCurves_6, hostElementId=id, rebarStyle=rebar_style, rebarBarType=longitudinal_rebar_bar_type, startHookOrientation=rebar_hook_orientation, endHookOrientation=rebar_hook_orientation, startHookType=rebar_hook_type, endHookType=rebar_hook_type, vector=reverse_2)
setLayoutAsFixedNumber_2 = StructuralDesign.Rebar.Layout.SetLayoutAsFixedNumber(rebar=byCurve_2, arrayLength=distribution_length_of_long, numberOfBarPositions=bars_along_b_direction)

setRebarShapeId = StructuralDesign.Rebar.Create.SetRebarShapeId(rebar=setLayoutAsFixedNumber, rebarShape=rebarShape)
setSolidInView = Custom[Rebar.SetSolidInView](rebarElements=setRebarShapeId, views=views)  # package BIM4Struc.Rebar; Sets this rebar element to be shown solidly in a 3D view.

# group: Create Longitudinal Rebar in Y Direction
byCurve_3 = Rebar.ByCurve(curve=byJoinedCurves_4, hostElementId=id, rebarStyle=rebar_style, rebarBarType=longitudinal_rebar_bar_type, startHookOrientation=rebar_hook_orientation, endHookOrientation=rebar_hook_orientation, startHookType=rebar_hook_type, endHookType=rebar_hook_type, vector=localCoordinateSystem.Yvector)
boolean = BoolSelector(false)
setLayoutAsFixedNumber_3 = StructuralDesign.Rebar.Layout.SetLayoutAsFixedNumber(rebar=byCurve_3, arrayLength=distribution_length_of_long_2, numberOfBarPositions=bars_along_h_direction, includeFirstBar=boolean, includeLastBar=boolean)
byCurve_4 = Rebar.ByCurve(curve=byJoinedCurves_5, hostElementId=id, rebarStyle=rebar_style, rebarBarType=longitudinal_rebar_bar_type, startHookOrientation=rebar_hook_orientation, endHookOrientation=rebar_hook_orientation, startHookType=rebar_hook_type, endHookType=rebar_hook_type, vector=reverse_3)
setLayoutAsFixedNumber_4 = StructuralDesign.Rebar.Layout.SetLayoutAsFixedNumber(rebar=byCurve_4, arrayLength=distribution_length_of_long_2, numberOfBarPositions=bars_along_h_direction, includeFirstBar=boolean, includeLastBar=boolean)

setRebarShapeId_2 = StructuralDesign.Rebar.Create.SetRebarShapeId(rebar=setLayoutAsFixedNumber_3, rebarShape=rebarShape)
setSolidInView_2 = Custom[Rebar.SetSolidInView](rebarElements=setRebarShapeId_2, views=views)
setRebarShapeId_3 = StructuralDesign.Rebar.Create.SetRebarShapeId(rebar=setLayoutAsFixedNumber_4, rebarShape=rebarShape)
setSolidInView_3 = Custom[Rebar.SetSolidInView](rebarElements=setRebarShapeId_3, views=views)
setRebarShapeId_4 = StructuralDesign.Rebar.Create.SetRebarShapeId(rebar=setLayoutAsFixedNumber_2, rebarShape=rebarShape)
setSolidInView_4 = Custom[Rebar.SetSolidInView](rebarElements=setRebarShapeId_4, views=views)
