# Dynamo graph Making Column Rebar for Top Column with Leg Length_1Nov2023.dyn (Dynamo 2.13.1.3887)
# packages: Dynamo for Rebar 2.0.2, Clockwork for Dynamo 2.x 2.6.0, BIM4Struc.Productivity 2.2.2, BIM4Struc.Rebar 1.3.0, archi-lab.net 2023.213.1722, Structural Design 2023.4.25

# group: Input
select_model_element_by_category = DSModelElementByCategorySelection("OST_StructuralColumns")  # 1 picked in the model; graph input
concrete_cover = DoubleInput(50)  # graph input
stirrup_rebar_bar_type = RebarBarType("10M", ElementType="Autodesk.Revit.DB.Structure.RebarBarType, RevitAPI, Version=23.0.0.0, Culture=neutral, PublicKeyToken=null")  # graph input
vertical_rebar_bar_type = RebarBarType("29M", ElementType="Autodesk.Revit.DB.Structure.RebarBarType, RevitAPI, Version=23.0.0.0, Culture=neutral, PublicKeyToken=null")  # graph input
special_length_rebar = DoubleInput(10400)  # graph input
top_l_shape_leg_length = DoubleInput(1000)  # graph input
amount_of_rebar_in_h_direction = CodeBlock { 4; }
amount_of_rebar_in_b_direction = CodeBlock { 5; }

# group: Obtain bottom surface of column
faces = Element.Faces(element=select_model_element_by_category)
code_block = CodeBlock { 1; }
flatten = List.Flatten(list=faces, amount=code_block)
filterByOrientation = Custom[Surface.FilterByOrientation](surfaces=flatten)  # package Clockwork for Dynamo 2.x; Sorts surfaces in three lists based on their orientation (vertical, horizontal up & horizontal down) and also returns three corresponding lists of booleans.

# group: Create Stirrup Curves
perimeterCurves = Surface.PerimeterCurves(surface=filterByOrientation.horizontalDown)
byJoinedCurves = PolyCurve.ByJoinedCurves(curves=perimeterCurves)
column_concrete_cover = CodeBlock(ConcreteCover=concrete_cover) { ConcreteCover*-1; }
offset = Curve.Offset(curve=byJoinedCurves, distance=column_concrete_cover)

getBarDiameter = Custom[RebarType.GetBarDiameter](rebarBarType=stirrup_rebar_bar_type)  # package BIM4Struc.Rebar; Get the diameter of a given Rebar Bar Type
getBarDiameter_2 = Custom[RebarType.GetBarDiameter](rebarBarType=vertical_rebar_bar_type)
code_block_2 = CodeBlock(StirrupDia=getBarDiameter, LongDia=getBarDiameter_2) { -1*(StirrupDia+LongDia*0.5); }
offset_2 = Curve.Offset(curve=offset, distance=code_block_2)
byJoinedCurves_2 = PolyCurve.ByJoinedCurves(curves=offset_2@L1)
curves = PolyCurve.Curves(polyCurve=byJoinedCurves_2)
startPoint = Curve.StartPoint(curve=curves@L1)
firstItem = List.FirstItem(list=startPoint@L2)
ZAxis = Vector.ZAxis()
reverse = Vector.Reverse(vector=ZAxis)
code_block_3 = CodeBlock { 877; }
byStartPointDirectionLength = Line.ByStartPointDirectionLength(startPoint=firstItem, direction=reverse, length=code_block_3)
endPoint = Curve.EndPoint(curve=byStartPointDirectionLength)
code_block_4 = CodeBlock(SpecialLength=special_length_rebar, HookLength=top_l_shape_leg_length) { SpecialLength-HookLength; }
byStartPointDirectionLength_2 = Line.ByStartPointDirectionLength(startPoint=endPoint, direction=ZAxis, length=code_block_4)

# group: Vector Management
localCoordinateSystem = Custom[Element.LocalCoordinateSystem](element=select_model_element_by_category)  # package BIM4Struc.Productivity; Get the insertion point and local axes of an element.
reverse_2 = Vector.Reverse(vector=localCoordinateSystem.Yvector)
reverse_3 = Vector.Reverse(vector=localCoordinateSystem.Xvector)

# group: Information to create longitudinal rebar
id = Element.Id(element=select_model_element_by_category)
rebar_style = RebarStyle("Standard", EnumerationType="Autodesk.Revit.DB.Structure.RebarStyle, RevitAPI, Version=23.0.0.0, Culture=neutral, PublicKeyToken=null")
rebar_hook_orientation = RebarHookOrientation("Left", EnumerationType="Autodesk.Revit.DB.Structure.RebarHookOrientation, RevitAPI, Version=23.0.0.0, Culture=neutral, PublicKeyToken=null")
rebar_hook_type = RevitRebarHookType("None", ElementType="Autodesk.Revit.DB.Structure.RebarHookType, RevitAPI, Version=23.0.0.0, Culture=neutral, PublicKeyToken=null")

# group: Calculate distribution length of longitudinal rebar
type = archilab.Revit.Elements.Elements.Type(element=select_model_element_by_category)
code_block_5 = CodeBlock { "b"; "h"; }
getParameterValueByName = Element.GetParameterValueByName(element=type, parameterName=code_block_5.out1)
distribution_length_of_long = CodeBlock(height=getParameterValueByName, ColumnCover=concrete_cover, StirrupDia=getBarDiameter, LongDia=getBarDiameter_2) { height-2*ColumnCover-2*StirrupDia-LongDia; }  # "Distribution Length of Long. Rebar in Y Direction"
getParameterValueByName_2 = Element.GetParameterValueByName(element=type, parameterName=code_block_5.out0)
distribution_length_of_long_2 = CodeBlock(width=getParameterValueByName_2, ColumnCover=concrete_cover, StirrupDia=getBarDiameter, LongDia=getBarDiameter_2) { width-2*ColumnCover-2*StirrupDia-LongDia; }  # "Distribution Length of Long. Rebar in X Direction"

code_block_6 = CodeBlock { 2; }
getItemAtIndex = List.GetItemAtIndex(list=startPoint@L2, index=code_block_6)
byStartPointDirectionLength_3 = Line.ByStartPointDirectionLength(startPoint=getItemAtIndex, direction=reverse, length=code_block_3)
endPoint_2 = Curve.EndPoint(curve=byStartPointDirectionLength_3)
byStartPointDirectionLength_4 = Line.ByStartPointDirectionLength(startPoint=endPoint_2, direction=ZAxis, length=code_block_4)

# group: Create Curve for Leg Length and Combine it with Longitudinal Rebar
endPoint_3 = Curve.EndPoint(curve=byStartPointDirectionLength_2)
byStartPointDirectionLength_5 = Line.ByStartPointDirectionLength(startPoint=endPoint_3, direction=localCoordinateSystem.Xvector, length=top_l_shape_leg_length)
list_create = List.Create(item0=byStartPointDirectionLength_2, item1=byStartPointDirectionLength_5)
transpose = List.Transpose(lists=list_create)
byJoinedCurves_3 = PolyCurve.ByJoinedCurves(curves=transpose)
endPoint_4 = Curve.EndPoint(curve=byStartPointDirectionLength_4)
byStartPointDirectionLength_6 = Line.ByStartPointDirectionLength(startPoint=endPoint_4, direction=reverse_2, length=top_l_shape_leg_length)
list_create_2 = List.Create(item0=byStartPointDirectionLength_4, item1=byStartPointDirectionLength_6)
transpose_2 = List.Transpose(lists=list_create_2)
byJoinedCurves_4 = PolyCurve.ByJoinedCurves(curves=transpose_2)
byStartPointDirectionLength_7 = Line.ByStartPointDirectionLength(startPoint=endPoint_3, direction=localCoordinateSystem.Yvector, length=top_l_shape_leg_length)
list_create_3 = List.Create(item0=byStartPointDirectionLength_2, item1=byStartPointDirectionLength_7)
transpose_3 = List.Transpose(lists=list_create_3)
byJoinedCurves_5 = PolyCurve.ByJoinedCurves(curves=transpose_3)
byStartPointDirectionLength_8 = Line.ByStartPointDirectionLength(startPoint=endPoint_4, direction=reverse_3, length=top_l_shape_leg_length)
list_create_4 = List.Create(item0=byStartPointDirectionLength_4, item1=byStartPointDirectionLength_8)
transpose_4 = List.Transpose(lists=list_create_4)
byJoinedCurves_6 = PolyCurve.ByJoinedCurves(curves=transpose_4)

# group: Create Longitudinal Rebar in Y Direction
byCurve = Rebar.ByCurve(curve=byJoinedCurves_3, hostElementId=id, rebarStyle=rebar_style, rebarBarType=vertical_rebar_bar_type, startHookOrientation=rebar_hook_orientation, endHookOrientation=rebar_hook_orientation, startHookType=rebar_hook_type, endHookType=rebar_hook_type, vector=reverse_2)
boolean = BoolSelector(false)
setLayoutAsFixedNumber = StructuralDesign.Rebar.Layout.SetLayoutAsFixedNumber(rebar=byCurve, arrayLength=distribution_length_of_long, numberOfBarPositions=amount_of_rebar_in_h_direction, includeFirstBar=boolean, includeLastBar=boolean)
byCurve_2 = Rebar.ByCurve(curve=byJoinedCurves_6, hostElementId=id, rebarStyle=rebar_style, rebarBarType=vertical_rebar_bar_type, startHookOrientation=rebar_hook_orientation, endHookOrientation=rebar_hook_orientation, startHookType=rebar_hook_type, endHookType=rebar_hook_type, vector=localCoordinateSystem.Yvector)
setLayoutAsFixedNumber_2 = StructuralDesign.Rebar.Layout.SetLayoutAsFixedNumber(rebar=byCurve_2, arrayLength=distribution_length_of_long, numberOfBarPositions=amount_of_rebar_in_h_direction, includeFirstBar=boolean, includeLastBar=boolean)

# group: Create Longitudinal Rebar in X Direction
byCurve_3 = Rebar.ByCurve(curve=byJoinedCurves_4, hostElementId=id, rebarStyle=rebar_style, rebarBarType=vertical_rebar_bar_type, startHookOrientation=rebar_hook_orientation, endHookOrientation=rebar_hook_orientation, startHookType=rebar_hook_type, endHookType=rebar_hook_type, vector=localCoordinateSystem.Xvector)
setLayoutAsFixedNumber_3 = StructuralDesign.Rebar.Layout.SetLayoutAsFixedNumber(rebar=byCurve_3, arrayLength=distribution_length_of_long_2, numberOfBarPositions=amount_of_rebar_in_b_direction)
byCurve_4 = Rebar.ByCurve(curve=byJoinedCurves_5, hostElementId=id, rebarStyle=rebar_style, rebarBarType=vertical_rebar_bar_type, startHookOrientation=rebar_hook_orientation, endHookOrientation=rebar_hook_orientation, startHookType=rebar_hook_type, endHookType=rebar_hook_type, vector=reverse_3)
setLayoutAsFixedNumber_4 = StructuralDesign.Rebar.Layout.SetLayoutAsFixedNumber(rebar=byCurve_4, arrayLength=distribution_length_of_long_2, numberOfBarPositions=amount_of_rebar_in_b_direction)

# group: Set Rebar Shape and Set as Solid in View
rebarShape = RevitRebarShape("BS8666 12")
setRebarShapeId = StructuralDesign.Rebar.Create.SetRebarShapeId(rebar=setLayoutAsFixedNumber, rebarShape=rebarShape)
views = Views()  # nothing selected
setSolidInView = Custom[Rebar.SetSolidInView](rebarElements=setRebarShapeId, views=views)  # package BIM4Struc.Rebar; Sets this rebar element to be shown solidly in a 3D view.
setRebarShapeId_2 = StructuralDesign.Rebar.Create.SetRebarShapeId(rebar=setLayoutAsFixedNumber_3, rebarShape=rebarShape)
setSolidInView_2 = Custom[Rebar.SetSolidInView](rebarElements=setRebarShapeId_2, views=views)
setRebarShapeId_3 = StructuralDesign.Rebar.Create.SetRebarShapeId(rebar=setLayoutAsFixedNumber_4, rebarShape=rebarShape)
setSolidInView_3 = Custom[Rebar.SetSolidInView](rebarElements=setRebarShapeId_3, views=views)
setRebarShapeId_4 = StructuralDesign.Rebar.Create.SetRebarShapeId(rebar=setLayoutAsFixedNumber_2, rebarShape=rebarShape)
setSolidInView_4 = Custom[Rebar.SetSolidInView](rebarElements=setRebarShapeId_4, views=views, solid=views)
