# Dynamo graph Making Remaining Rebar_Rebar1_1Nov2023.dyn (Dynamo 2.13.1.3887)
# packages: Dynamo for Rebar 2.0.2, Clockwork for Dynamo 2.x 2.6.0, BIM4Struc.Productivity 2.2.2, BIM4Struc.Rebar 1.3.0, archi-lab.net 2023.213.1722, Structural Design 2023.4.25

# group: Input
select_model_element_by_category = DSModelElementByCategorySelection("OST_StructuralColumns")  # 1 picked in the model; graph input
concrete_cover = DoubleInput(50)  # graph input
vertical_rebar_bar_type = RebarBarType("29M", ElementType="Autodesk.Revit.DB.Structure.RebarBarType, RevitAPI, Version=23.0.0.0, Culture=neutral, PublicKeyToken=null")  # graph input
stirrup_rebar_bar_type = RebarBarType("10M", ElementType="Autodesk.Revit.DB.Structure.RebarBarType, RevitAPI, Version=23.0.0.0, Culture=neutral, PublicKeyToken=null")  # graph input
length_of_remaining_rebar = DoubleInput(1680)  # graph input
bars_along_h_direction = DoubleInput(10)  # graph input
bars_along_b_direction = DoubleInput(4)  # graph input

# group: Obtain bottom surface of column
faces = Element.Faces(element=select_model_element_by_category)
code_block = CodeBlock { 1; }
flatten = List.Flatten(list=faces, amount=code_block)
filterByOrientation = Custom[Surface.FilterByOrientation](surfaces=flatten)  # package Clockwork for Dynamo 2.x; Sorts surfaces in three lists based on their orientation (vertical, horizontal up & horizontal down) and also returns three corresponding lists of booleans.

# group: Get Longitudinal Rebar Location at The Bottom Surface of Column
getBarDiameter = Custom[RebarType.GetBarDiameter](rebarBarType=vertical_rebar_bar_type)  # package BIM4Struc.Rebar; Get the diameter of a given Rebar Bar Type
getBarDiameter_2 = Custom[RebarType.GetBarDiameter](rebarBarType=stirrup_rebar_bar_type)
code_block_2 = CodeBlock(StirrupDia=getBarDiameter_2, LongDia=getBarDiameter) { -1*(StirrupDia+LongDia*0.5); }
code_block_3 = CodeBlock { 2; }

# group: Create Stirrup Curves
perimeterCurves = Surface.PerimeterCurves(surface=filterByOrientation.horizontalDown)
byJoinedCurves = PolyCurve.ByJoinedCurves(curves=perimeterCurves)
column_concrete_cover = CodeBlock(ConcreteCover=concrete_cover, LongDia=getBarDiameter) { (ConcreteCover+LongDia)*-1; }
offset = Curve.Offset(curve=byJoinedCurves, distance=column_concrete_cover)

# group (continued): Get Longitudinal Rebar Location at The Bottom Surface of Column
offset_2 = Curve.Offset(curve=offset, distance=code_block_2)
byJoinedCurves_2 = PolyCurve.ByJoinedCurves(curves=offset_2@L1)
curves = PolyCurve.Curves(polyCurve=byJoinedCurves_2)
startPoint = Curve.StartPoint(curve=curves@L1)
getItemAtIndex = List.GetItemAtIndex(list=startPoint@L2, index=code_block_3)
firstItem = List.FirstItem(list=startPoint@L2)

# group: Create Curve for Longitudinal Rebar
ZAxis = Vector.ZAxis()
reverse = Vector.Reverse(vector=ZAxis)
code_block_4 = CodeBlock { 333; }
byStartPointDirectionLength = Line.ByStartPointDirectionLength(startPoint=getItemAtIndex, direction=reverse, length=code_block_4)
endPoint = Curve.EndPoint(curve=byStartPointDirectionLength)
byStartPointDirectionLength_2 = Line.ByStartPointDirectionLength(startPoint=endPoint, direction=ZAxis, length=length_of_remaining_rebar)
byStartPointDirectionLength_3 = Line.ByStartPointDirectionLength(startPoint=firstItem, direction=reverse, length=code_block_4)
endPoint_2 = Curve.EndPoint(curve=byStartPointDirectionLength_3)
byStartPointDirectionLength_4 = Line.ByStartPointDirectionLength(startPoint=endPoint_2, direction=ZAxis, length=length_of_remaining_rebar)

# group: Create Curve for Leg Length and Combine it with Longitudinal Rebar
list_create = List.Create(item0=byStartPointDirectionLength_2)
transpose = List.Transpose(lists=list_create)
byJoinedCurves_3 = PolyCurve.ByJoinedCurves(curves=transpose)
list_create_2 = List.Create(item0=byStartPointDirectionLength_2)
transpose_2 = List.Transpose(lists=list_create_2)
byJoinedCurves_4 = PolyCurve.ByJoinedCurves(curves=transpose_2)
list_create_3 = List.Create(item0=byStartPointDirectionLength_4)
transpose_3 = List.Transpose(lists=list_create_3)
byJoinedCurves_5 = PolyCurve.ByJoinedCurves(curves=transpose_3)
list_create_4 = List.Create(item0=byStartPointDirectionLength_4)
transpose_4 = List.Transpose(lists=list_create_4)
byJoinedCurves_6 = PolyCurve.ByJoinedCurves(curves=transpose_4)

# group: Information to create longitudinal rebar
id = Element.Id(element=select_model_element_by_category)
rebar_style = RebarStyle("Standard", EnumerationType="Autodesk.Revit.DB.Structure.RebarStyle, RevitAPI, Version=23.0.0.0, Culture=neutral, PublicKeyToken=null")
rebar_hook_orientation = RebarHookOrientation("Left", EnumerationType="Autodesk.Revit.DB.Structure.RebarHookOrientation, RevitAPI, Version=23.0.0.0, Culture=neutral, PublicKeyToken=null")
rebar_hook_type = RevitRebarHookType("None", ElementType="Autodesk.Revit.DB.Structure.RebarHookType, RevitAPI, Version=23.0.0.0, Culture=neutral, PublicKeyToken=null")

# group: Vector Management
localCoordinateSystem = Custom[Element.LocalCoordinateSystem](element=select_model_element_by_category)  # package BIM4Struc.Productivity; Get the insertion point and local axes of an element.
reverse_2 = Vector.Reverse(vector=localCoordinateSystem.Yvector)
reverse_3 = Vector.Reverse(vector=localCoordinateSystem.Xvector)

# group: Get column and longitudinal rebar parameter
type = archilab.Revit.Elements.Elements.Type(element=select_model_element_by_category)
code_block_5 = CodeBlock { "b"; "h"; }
getParameterValueByName = Element.GetParameterValueByName(element=type, parameterName=code_block_5.out1)
getParameterValueByName_2 = Element.GetParameterValueByName(element=type, parameterName=code_block_5.out0)

# group: Calculate distribution length of longitudinal rebar
distribution_length_of_long = CodeBlock(height=getParameterValueByName, ColumnCover=concrete_cover, StirrupDia=getBarDiameter_2, LongDia=getBarDiameter) { height-2*ColumnCover-2*StirrupDia-3*LongDia; }  # "Distribution Length of Long. Rebar in Y Direction"
distribution_length_of_long_2 = CodeBlock(width=getParameterValueByName_2, ColumnCover=concrete_cover, StirrupDia=getBarDiameter_2, LongDia=getBarDiameter) { width-2*ColumnCover-2*StirrupDia-3*LongDia; }  # "Distribution Length of Long. Rebar in X Direction"

# group: Create Longitudinal Rebar in Y Direction
byCurve = Rebar.ByCurve(curve=byJoinedCurves_3, hostElementId=id, rebarStyle=rebar_style, rebarBarType=vertical_rebar_bar_type, startHookOrientation=rebar_hook_orientation, endHookOrientation=rebar_hook_orientation, startHookType=rebar_hook_type, endHookType=rebar_hook_type, vector=localCoordinateSystem.Yvector)  # frozen
boolean = BoolSelector(false)
setLayoutAsFixedNumber = StructuralDesign.Rebar.Layout.SetLayoutAsFixedNumber(rebar=byCurve, arrayLength=distribution_length_of_long, numberOfBarPositions=bars_along_h_direction, includeFirstBar=boolean, includeLastBar=boolean)
byCurve_2 = Rebar.ByCurve(curve=byJoinedCurves_5, hostElementId=id, rebarStyle=rebar_style, rebarBarType=vertical_rebar_bar_type, startHookOrientation=rebar_hook_orientation, endHookOrientation=rebar_hook_orientation, startHookType=rebar_hook_type, endHookType=rebar_hook_type, vector=reverse_2)  # frozen
setLayoutAsFixedNumber_2 = StructuralDesign.Rebar.Layout.SetLayoutAsFixedNumber(rebar=byCurve_2, arrayLength=distribution_length_of_long, numberOfBarPositions=bars_along_h_direction, includeFirstBar=boolean, includeLastBar=boolean)

# group: Create Longitudinal Rebar in X Direction
byCurve_3 = Rebar.ByCurve(curve=byJoinedCurves_4, hostElementId=id, rebarStyle=rebar_style, rebarBarType=vertical_rebar_bar_type, startHookOrientation=rebar_hook_orientation, endHookOrientation=rebar_hook_orientation, startHookType=rebar_hook_type, endHookType=rebar_hook_type, vector=localCoordinateSystem.Xvector)
boolean_2 = BoolSelector(false)
setLayoutAsFixedNumber_3 = StructuralDesign.Rebar.Layout.SetLayoutAsFixedNumber(rebar=byCurve_3, arrayLength=distribution_length_of_long_2, numberOfBarPositions=bars_along_b_direction, includeFirstBar=boolean_2, includeLastBar=boolean_2)
byCurve_4 = Rebar.ByCurve(curve=byJoinedCurves_6, hostElementId=id, rebarStyle=rebar_style, rebarBarType=vertical_rebar_bar_type, startHookOrientation=rebar_hook_orientation, endHookOrientation=rebar_hook_orientation, startHookType=rebar_hook_type, endHookType=rebar_hook_type, vector=reverse_3)
setLayoutAsFixedNumber_4 = StructuralDesign.Rebar.Layout.SetLayoutAsFixedNumber(rebar=byCurve_4, arrayLength=distribution_length_of_long_2, numberOfBarPositions=bars_along_b_direction, includeFirstBar=boolean_2, includeLastBar=boolean_2)

# group: Set Rebar Shape and Set as Solid in View
rebarShape = RevitRebarShape("BS8666 00")
setRebarShapeId = StructuralDesign.Rebar.Create.SetRebarShapeId(rebar=setLayoutAsFixedNumber, rebarShape=rebarShape)
views = Views("{3D}")
setSolidInView = Custom[Rebar.SetSolidInView](rebarElements=setRebarShapeId, views=views, solid=views)  # package BIM4Struc.Rebar; Sets this rebar element to be shown solidly in a 3D view.
setRebarShapeId_2 = StructuralDesign.Rebar.Create.SetRebarShapeId(rebar=setLayoutAsFixedNumber_3, rebarShape=rebarShape)
setSolidInView_2 = Custom[Rebar.SetSolidInView](rebarElements=setRebarShapeId_2, views=views)
setRebarShapeId_3 = StructuralDesign.Rebar.Create.SetRebarShapeId(rebar=setLayoutAsFixedNumber_2, rebarShape=rebarShape)
setSolidInView_3 = Custom[Rebar.SetSolidInView](rebarElements=setRebarShapeId_3, views=views)
setRebarShapeId_4 = StructuralDesign.Rebar.Create.SetRebarShapeId(rebar=setLayoutAsFixedNumber_4, rebarShape=rebarShape)
setSolidInView_4 = Custom[Rebar.SetSolidInView](rebarElements=setRebarShapeId_4, views=views)
