# Dynamo graph Making Remaining Rebar_Rebar2_1Nov2023.dyn (Dynamo 2.13.1.3887)
# packages: Dynamo for Rebar 2.0.2, Clockwork for Dynamo 2.x 2.6.0, BIM4Struc.Productivity 2.2.2, BIM4Struc.Rebar 1.3.0, archi-lab.net 2023.213.1722, Structural Design 2023.4.25, LunchBox for Dynamo 2017.10.2

# group: Input
select_model_element_by_category = DSModelElementByCategorySelection("OST_StructuralColumns")  # 1 picked in the model; graph input
concrete_cover = DoubleInput(50)  # graph input
vertical_rebar_bar_type = RebarBarType(ElementType="Autodesk.Revit.DB.Structure.RebarBarType, RevitAPI, Version=23.0.0.0, Culture=neutral, PublicKeyToken=null")  # nothing selected; graph input
stirrup_rebar_bar_type = RebarBarType(ElementType="Autodesk.Revit.DB.Structure.RebarBarType, RevitAPI, Version=23.0.0.0, Culture=neutral, PublicKeyToken=null")  # nothing selected; graph input
remaining_rebar_length = DoubleInput(7780)  # graph input
bars_along_h_direction = DoubleInput(3)  # graph input
bars_along_b_direction = DoubleInput(3)  # graph input; frozen

# group: Obtain bottom surface of column
faces = Element.Faces(element=select_model_element_by_category)
code_block = CodeBlock { 1; }
flatten = List.Flatten(list=faces, amount=code_block)
filterByOrientation = Custom[Surface.FilterByOrientation](surfaces=flatten)  # package Clockwork for Dynamo 2.x; Sorts surfaces in three lists based on their orientation (vertical, horizontal up & horizontal down) and also returns three corresponding lists of booleans.

perimeterCurves = Surface.PerimeterCurves(surface=filterByOrientation.horizontalDown)
firstItem = List.FirstItem(list=perimeterCurves@L2)

# group: Get Longitudinal Rebar Location at The Bottom Surface of Column
getBarDiameter = Custom[RebarType.GetBarDiameter](rebarBarType=vertical_rebar_bar_type)  # package BIM4Struc.Rebar; Get the diameter of a given Rebar Bar Type
getBarDiameter_2 = Custom[RebarType.GetBarDiameter](rebarBarType=stirrup_rebar_bar_type)
code_block_2 = CodeBlock(StirrupDia=getBarDiameter_2, LongDia=getBarDiameter) { -1*(StirrupDia+LongDia*0.5); }
code_block_3 = CodeBlock { 2; }

column_concrete_cover = CodeBlock(ConcreteCover=concrete_cover, LongDia=getBarDiameter) { (ConcreteCover+2*LongDia); }
offset = Curve.Offset(curve=firstItem, distance=column_concrete_cover)
code_block_4 = CodeBlock { 1; }
getItemAtIndex = List.GetItemAtIndex(list=perimeterCurves@L2, index=code_block_4)
additional_cover = DoubleInput(100)  # graph input
code_block_5 = CodeBlock(Cover=concrete_cover, additionalcover=additional_cover) { Cover+additionalcover; }
offset_2 = Curve.Offset(curve=getItemAtIndex, distance=code_block_5)
findIntersections = Geometry.Intersection.FindIntersections(geo=offset, others=offset_2)
code_block_6 = CodeBlock { 2; }
getItemAtIndex_2 = List.GetItemAtIndex(list=perimeterCurves@L2, index=code_block_6)
offset_3 = Curve.Offset(curve=getItemAtIndex_2, distance=column_concrete_cover)
findIntersections_2 = Geometry.Intersection.FindIntersections(geo=offset_2, others=offset_3)
lastItem = List.LastItem(list=perimeterCurves@L2)
offset_4 = Curve.Offset(curve=lastItem, distance=code_block_5)
findIntersections_3 = Geometry.Intersection.FindIntersections(geo=offset_3, others=offset_4)
findIntersections_4 = Geometry.Intersection.FindIntersections(geo=offset_4, others=offset)
byCornerPoints = Rectangle.ByCornerPoints(p1=findIntersections, p2=findIntersections_2, p3=findIntersections_3, p4=findIntersections_4)
byJoinedCurves = PolyCurve.ByJoinedCurves(curves=byCornerPoints)

# group (continued): Get Longitudinal Rebar Location at The Bottom Surface of Column
offset_5 = Curve.Offset(curve=byJoinedCurves, distance=code_block_2)
byJoinedCurves_2 = PolyCurve.ByJoinedCurves(curves=offset_5@L1)
curves = PolyCurve.Curves(polyCurve=byJoinedCurves_2)
startPoint = Curve.StartPoint(curve=curves@L1)
getItemAtIndex_3 = List.GetItemAtIndex(list=startPoint@L2, index=code_block_3)
firstItem_2 = List.FirstItem(list=startPoint@L2)

# group: Create Curve for Longitudinal Rebar
ZAxis = Vector.ZAxis()
reverse = Vector.Reverse(vector=ZAxis)
code_block_7 = CodeBlock { 3106; }
byStartPointDirectionLength = Line.ByStartPointDirectionLength(startPoint=getItemAtIndex_3, direction=reverse, length=code_block_7)
endPoint = Curve.EndPoint(curve=byStartPointDirectionLength)
byStartPointDirectionLength_2 = Line.ByStartPointDirectionLength(startPoint=endPoint, direction=ZAxis, length=remaining_rebar_length)
byStartPointDirectionLength_3 = Line.ByStartPointDirectionLength(startPoint=firstItem_2, direction=reverse, length=code_block_7)
endPoint_2 = Curve.EndPoint(curve=byStartPointDirectionLength_3)
byStartPointDirectionLength_4 = Line.ByStartPointDirectionLength(startPoint=endPoint_2, direction=ZAxis, length=remaining_rebar_length)

# group: Create Curve for Leg Length and Combine it with Longitudinal Rebar
list_create = List.Create(item0=byStartPointDirectionLength_2)
transpose = List.Transpose(lists=list_create)
byJoinedCurves_3 = PolyCurve.ByJoinedCurves(curves=transpose)
list_create_2 = List.Create(item0=byStartPointDirectionLength_2)
transpose_2 = List.Transpose(lists=list_create_2)
byJoinedCurves_4 = PolyCurve.ByJoinedCurves(curves=transpose_2)
list_create_3 = List.Create(item0=byStartPointDirectionLength_4)
transpose_3 = List.Transpose(lists=list_create_3)
byJoinedCurves_5 = PolyCurve.ByJoinedCurves(curves=transpose_3)
list_create_4 = List.Create(item0=byStartPointDirectionLength_4)
transpose_4 = List.Transpose(lists=list_create_4)
byJoinedCurves_6 = PolyCurve.ByJoinedCurves(curves=transpose_4)

# group: Information to create longitudinal rebar
id = Element.Id(element=select_model_element_by_category)
rebar_style = RebarStyle("Standard", EnumerationType="Autodesk.Revit.DB.Structure.RebarStyle, RevitAPI, Version=23.0.0.0, Culture=neutral, PublicKeyToken=null")
rebar_hook_orientation = RebarHookOrientation("Left", EnumerationType="Autodesk.Revit.DB.Structure.RebarHookOrientation, RevitAPI, Version=23.0.0.0, Culture=neutral, PublicKeyToken=null")
rebar_hook_type = RevitRebarHookType("None", ElementType="Autodesk.Revit.DB.Structure.RebarHookType, RevitAPI, Version=23.0.0.0, Culture=neutral, PublicKeyToken=null")

# group: Vector Management
localCoordinateSystem = Custom[Element.LocalCoordinateSystem](element=select_model_element_by_category)  # package BIM4Struc.Productivity; Get the insertion point and local axes of an element.
reverse_2 = Vector.Reverse(vector=localCoordinateSystem.Yvector)
reverse_3 = Vector.Reverse(vector=localCoordinateSystem.Xvector)

# group: Get column and longitudinal rebar parameter
type = archilab.Revit.Elements.Elements.Type(element=select_model_element_by_category)
code_block_8 = CodeBlock { "b"; "h"; }
getParameterValueByName = Element.GetParameterValueByName(element=type, parameterName=code_block_8.out1)
getParameterValueByName_2 = Element.GetParameterValueByName(element=type, parameterName=code_block_8.out0)

# group: Calculate distribution length of longitudinal rebar
distribution_length_of_long = CodeBlock(height=getParameterValueByName, ColumnCover=concrete_cover, StirrupDia=getBarDiameter_2, LongDia=getBarDiameter, Additionalcover=additional_cover) { height-2*ColumnCover-2*StirrupDia-LongDia-Additionalcover; }  # "Distribution Length of Long. Rebar in Y Direction"
distribution_length_of_long_2 = CodeBlock(width=getParameterValueByName_2, ColumnCover=concrete_cover, StirrupDia=getBarDiameter_2, LongDia=getBarDiameter) { width-2*ColumnCover-2*StirrupDia-5*LongDia; }  # "Distribution Length of Long. Rebar in X Direction"

# group: Create Longitudinal Rebar in Y Direction
byCurve = Rebar.ByCurve(curve=byJoinedCurves_3, hostElementId=id, rebarStyle=rebar_style, rebarBarType=vertical_rebar_bar_type, startHookOrientation=rebar_hook_orientation, endHookOrientation=rebar_hook_orientation, startHookType=rebar_hook_type, endHookType=rebar_hook_type, vector=reverse_2)
boolean = BoolSelector(false)
setLayoutAsFixedNumber = StructuralDesign.Rebar.Layout.SetLayoutAsFixedNumber(rebar=byCurve, arrayLength=distribution_length_of_long, numberOfBarPositions=bars_along_h_direction, includeFirstBar=boolean, includeLastBar=boolean)
byCurve_2 = Rebar.ByCurve(curve=byJoinedCurves_5, hostElementId=id, rebarStyle=rebar_style, rebarBarType=vertical_rebar_bar_type, startHookOrientation=rebar_hook_orientation, endHookOrientation=rebar_hook_orientation, startHookType=rebar_hook_type, endHookType=rebar_hook_type, vector=localCoordinateSystem.Yvector)
setLayoutAsFixedNumber_2 = StructuralDesign.Rebar.Layout.SetLayoutAsFixedNumber(rebar=byCurve_2, arrayLength=distribution_length_of_long, numberOfBarPositions=bars_along_h_direction, includeFirstBar=boolean, includeLastBar=boolean)

rebarShape = RevitRebarShape("BS8666 00")

# group: Create Longitudinal Rebar in X Direction
byCurve_3 = Rebar.ByCurve(curve=byJoinedCurves_4, hostElementId=id, rebarStyle=rebar_style, rebarBarType=vertical_rebar_bar_type, startHookOrientation=rebar_hook_orientation, endHookOrientation=rebar_hook_orientation, startHookType=rebar_hook_type, endHookType=rebar_hook_type, vector=localCoordinateSystem.Xvector)
setLayoutAsFixedNumber_3 = StructuralDesign.Rebar.Layout.SetLayoutAsFixedNumber(rebar=byCurve_3, arrayLength=distribution_length_of_long_2, numberOfBarPositions=bars_along_b_direction)
byCurve_4 = Rebar.ByCurve(curve=byJoinedCurves_6, hostElementId=id, rebarStyle=rebar_style, rebarBarType=vertical_rebar_bar_type, startHookOrientation=rebar_hook_orientation, endHookOrientation=rebar_hook_orientation, startHookType=rebar_hook_type, endHookType=rebar_hook_type, vector=reverse_3)
setLayoutAsFixedNumber_4 = StructuralDesign.Rebar.Layout.SetLayoutAsFixedNumber(rebar=byCurve_4, arrayLength=distribution_length_of_long_2, numberOfBarPositions=bars_along_b_direction)

# group: Set Rebar Shape and Set as Solid in View
setRebarShapeId = StructuralDesign.Rebar.Create.SetRebarShapeId(rebar=setLayoutAsFixedNumber, rebarShape=rebarShape)
views = Views("{3D}")
setSolidInView = Custom[Rebar.SetSolidInView](rebarElements=setRebarShapeId, views=views, solid=views)  # package BIM4Struc.Rebar; Sets this rebar element to be shown solidly in a 3D view.
setRebarShapeId_2 = StructuralDesign.Rebar.Create.SetRebarShapeId(rebar=setLayoutAsFixedNumber_3, rebarShape=rebarShape)
setSolidInView_2 = Custom[Rebar.SetSolidInView](rebarElements=setRebarShapeId_2, views=views)
setRebarShapeId_3 = StructuralDesign.Rebar.Create.SetRebarShapeId(rebar=setLayoutAsFixedNumber_2, rebarShape=rebarShape)
setSolidInView_3 = Custom[Rebar.SetSolidInView](rebarElements=setRebarShapeId_3, views=views)
setRebarShapeId_4 = StructuralDesign.Rebar.Create.SetRebarShapeId(rebar=setLayoutAsFixedNumber_4, rebarShape=rebarShape)
setSolidInView_4 = Custom[Rebar.SetSolidInView](rebarElements=setRebarShapeId_4, views=views)
